vi "Main.gvi"   [LabVIEW NXG 5.0.0]
# This template is for the Queued Message Handler design pattern. The Event Handling Loop generates messages based on user interface actions. The Message Handling Loop processes messages generated by the Event Handling Loop, or by other messages. The messages are string values, so new messages can be added easily to the Message Cases case structure in the Message Handling Loop. Each message cluster can also provide an optional value for Message Data, which is a variant that can be converted to whatever message-specific data is required.
panel controls:
  "Exit": bool
  "TEMP Button": bool
  "LUX Button": bool
  "VISA Resource Name": "VISA Instr" = "COM5"
  "Initialize VISA": bool
  "CMD Button": bool
  "Initialize AI": bool
  "Panel Config Button": bool
  "Set PV Angle Button": bool
  "IR Thermometer Position": bool
  "Fans Button": bool
  "Brightness Config Button": bool
  "Optic Filter Config Button": bool
  "Reset CVM Button": bool
  "Stop": bool
  "Panel Config Selector": string
  "PV Angle": i32
  "Fans Selector": string
  "Optic Filter Selector": string
  "IR Thermometer Position Selector": string
  "Brightness": i32
  "Prepare CVM": bool
  "Command to Arduino": string = "@DO 34 0#"
  "Set LoadR": bool
  "No Load": bool
  "Set LoadRTotal": string
  "VAC Button": bool
  "Heat Selector": string
  "Heat Button": bool
  "Exit 2": bool
  "Do Something": bool
  "Do Something Else": bool
  "Tab": i32
  "LoadR1": string
  "LoadR10": string
  "LoadR100": string
  "LoadR1000": string
  "Measured Data": "Measured Data.gtype"
  "Receive MV": bool
panel indicators:
  "Display": string
  "Command reply": "ArduinoReply.gtype"
  "LUXSensor Reply": "ArduinoReply.gtype"
  "TempSensor Reply": "ArduinoReply.gtype"
  "AI measurements": waveform<f64>[]
  "Hardware Current Status": string
  "V Coeff": f64
  "C Coeff": f64
  "Recalculated Voltage": f64
  "Recalculated Current": f64
  "VAC Load Counter": i32
  "Voltage_Graph": f64[]
  "VISA Answer_2": "ArduinoReply.gtype"[]
  "Current_Graph": f64[]
  "VAC": cluster{"Element 1": f64[], "Element 2": f64[]}
  "PV-Connecting Solar Panels": string
  "MV-Panel Configuration": string
  "MV-Cooling": string
  "MV-Heating": string
  "MV-Optical Filter": string
  "MV-Panel Tilt Angle": string
  "MV-Light Power": string
  "MV-LoadR1": string
  "MV-LoadR2": string
  "MV-LoadR3": string
  "MV-LoadR4": string
  "API Key": string
  "Server URL": string
  "Status of Send to SystemLink Cycle": string
  "PV-Current, mA": f64
  "SendDoubleToCloud": string
  "PV-LoadR,Ohm": f64
  "PV-Voltage, V": f64
  "PV-Temperature, ºC": f64
  "PV-LightIntensity, W/m2": f64
  "PV-Panel Tilt Angle, º": f64
  "PV-Panel Cofiguration": string
  "SendStringToCloud": string
  "PV-Cooling": string
  "PV-Heating": string
  "PV-Optical Filter": string
  "PV-LoadR1": string
  "PV-LoadR2": string
  "PV-LoadR3": string
  "PV-LoadR4": string
  "Error out Systemlink Read Cycle": error
  "Voltage MidPoint": f64
  "Current MidPoint": f64
  "Arduino Status": string
  "SendArrayDoubleToCloud": string
  "TempSensor": f64
  "LuxSensor": f64
  "LuxSensor Error": string
  "Total Set LoadR": i32
  "TempSensor Error": string
  "MV-LoadRTotal": string
  "Voltage EndPoint": f64
  "Current EndPoint": f64
  "TempSensor IR": f64
  "PV-LoadRTotal": string
  "PV-Temperature IR Position": string
  "PV-LigthPower, %": f64
  "PV-Temperature IR, ºC": f64
  "Total LoadR_SET": string
types:
  "ArduinoReply.gtype" = cluster{"Timestamp": timestamp, "DATA": string}
  "Measured Data.gtype" = cluster{"Voltage, V": f64, "Current, mA": f64, "Luminous Flux, Lux": f64, "Temperature, GradC": f64, "Temperature IR, GradC": f64}
  T1 = cluster{"VISA Resource": "VISA Instr", "Physical Channel": "DAQmx Task"}
  "UI Data.gtype" = cluster{"Boolean": bool, "String": string, "Numeric": f64}
  "ValueRange.gtype" = cluster{"maximum value": f64, "minimum value": f64}
uses:
  NI::Skyline::Configuration::Open Configuration API Key.gvi
  NI::Skyline::TagHTTP::Query Tags.gvi
  NI::Skyline::TagHTTP::Open Tag.gvi
  NI::Skyline::TagHTTP::Read Tag (String).gvi
  NI::Skyline::TagHTTP::Close Tag (Single).gvi
  NI::Skyline::Configuration::Close Configuration.gvi
  Message Queue::Create All Message Queues.gvi
  Message Queue::Enqueue Message (Single).gvi
  Support::Error Handler - Event Handling Loop.gvi
  Message Queue::Dequeue Message.gvi
  NI::VISA::Configure Serial Port (Instr).gvi
  NI::VISA::Open (Instr).gvi
  NI::DAQmx::Internal::DAQmx Create Channel (AI-Voltage-Basic).gvi
  Queued Message Handler::VISA ReadWrite.gvi
  Queued Message Handler::VISA Reply Parse.gvi
  NI::DAQmx::Internal::DAQmx Read (Analog 2D DBL NChan NSamp).gvi
  NI::DAQmx::Internal::DAQmx Read (Analog 1D Wfm NChan NSamp).gvi
  Queued Message Handler::Panel Switch.gvi
  Queued Message Handler::VISA Multiple Write.gvi
  NI::G Core::Error::Display Error.gvi
  NI::DAQmx::Internal::DAQmx Stop Task.gvi
  NI::VISA::Close (Instr).gvi
  NI::G Core::Error::Build Error Cluster.gvi
  Support::Error Handler - Message Handling Loop.gvi
  NI::Skyline::TagHTTP::Write Tag (DBL).gvi
  NI::Skyline::TagHTTP::Write Tag (String).gvi
  NI::Vision::IMAQdx::Initialize.gvi
  NI::Vision::IMAQdx::Configure Grab.gvi
  NI::Vision::Core::Basics::Create Image.gvi
  NI::Vision::IMAQdx::Grab.gvi
  NI::Vision::IMAQdx::Close.gvi
diagram:
  $"MV-Panel Configuration" <- ""
  $"MV-Cooling" <- ""
  $"MV-Heating" <- ""
  $"MV-Optical Filter" <- ""
  $"MV-Panel Tilt Angle" <- ""
  $"MV-Light Power" <- ""
  $"MV-LoadR1" <- ""
  $"MV-LoadR2" <- ""
  $"MV-LoadR3" <- ""
  $"MV-LoadR4" <- ""
  $"MV-LoadRTotal" <- ""
  # PV Config
  # 	Single
  # 	Parallel 2
  # 	Parallel 2 Diode
  # 	Series 2
  # 	Series 2 Diode
  # 	Parallel 4
  # 	Parallel 4 Diode
  # 	Series 4
  # 	Series 4 Diode
  # 	Parallel Of Series
  # 	Parallel Of Series Diode
  # 	Series Of Parallel
  # 	Series Of Parallel Diode
  # Optic Filter Config
  # 	No Filter
  # 	Filter 1
  # 	Filter 2
  # IR Thermomether
  # 	None
  # 	Panel 1
  # 	Panel 2
  # 	Panel 3
  # 	Panel 4
  # Heating/Cooling
  # 	0
  # 	50
  # 	100
  # Light Power
  # 	0 ... 100
  # Panel Tilt Angle
  # 	0 ... 120
  # Load 1
  # 	1,2,3,5;
  # Load 2
  # 	10,20.40,50;
  # Load 3
  # 	100,200,400,500;
  # Load 4
  # 	1000,2000,4000;
  w1 = ["MV-Panels Configuration", "MV-Cooling", "MV-Heating", "MV-Optical Filter", "MV-Panel Tilt Angle", "MV-Light Power", "MV-LoadR1", "MV-LoadR2", "MV-LoadR3", "MV-LoadR4", "MV-LoadRTotal"]
  Array Size(array=w1) -> (size(s)=w2)
  Initialize Array(element=1904-12-31T23:00:00Z, size=w2) -> w3
  sequence {
    frame 0 {
      Wait(time to wait=20000)
    }
  }
  s1 = w3  # shift register
  while {
    Wait(time to wait=500)
    case ($"Receive MV") {
      frame False, Default {
        w4 = s1
      }
      frame True {
        call "Open Configuration API Key.gvi"(server url=$"Server URL", api key=$"API Key") -> (configuration=w5, error out=w6)
        call "Query Tags.gvi"(paths=w1, error in=w6, configuration=w5) -> (tags=w7, error out=w8)
        Build Array(reference to "MV-Panel Configuration", reference to "MV-Cooling", reference to "MV-Heating", reference to "MV-Optical Filter", reference to "MV-Panel Tilt Angle", reference to "MV-Light Power", reference to "MV-LoadR1", reference to "MV-LoadR2", reference to "MV-LoadR3", reference to "MV-LoadR4", reference to "MV-LoadRTotal") -> w9
        for {
          w10 = each element of w7
          w11 = each element of s1
          w12 = each element of w9
          Property Node(instance in=w10) -> ("Path"=w13, "Datatype"=w14)
          call "Open Tag.gvi"(path=w13, data type=w14, error in=w8, configuration=w5) -> (tag=w15, error out=w16)
          call "Read Tag (String).gvi"(tag in=w15, error in=w16) -> (value=w17, time stamp=w18, error out=w19)
          Is Greater(x=w18, y=w11) -> w20
          case (w20) {
            frame False, Default { }
            frame True {
              Property Node(instance in=w12, "ValueSignaling"=w17)
            }
          }
          append w18 to w4
        }
        for {
          w21 = each element of w7
          call "Close Tag (Single).gvi"(tag=w21, error in=w19) -> (error out=w22)
        }
        call "Close Configuration.gvi"(configuration=w5, error in=w22) -> (error out=w23)
        $"Error out Systemlink Read Cycle" <- w23
      }
    }
    next s1 = w4
    stop if $"Exit 2"
  }
  $"PV-Connecting Solar Panels" <- ""
  disable {
    frame Enabled { }
    frame Disabled {
      Destroy User Event()
    }
  }
  w24 = bool FALSE  # Stop Event
  Create User Event[EventName="Stop Event"](user event data type=w24) -> (error out=w25, user event out=w26)
  Register For Events("Stop Event"=w26) -> (event registration refnum out=w27)
  call "Create All Message Queues.gvi"(error in=w25) -> (message queues=w28, error out=w29)
  Property Node(instance in=w28) -> ("UI"=w30)
  s2 = w27  # shift register
  while {
    event (dynamic events = s2) {
      on "Exit" Value changed {
        call "Enqueue Message (Single).gvi"(priority message=TRUE, message queue in=w30, message="Exit") -> (message queue out=w33, error out=w32)
        w31 = default
      }
      on dynamic event 0 {
        $Display <- "\"Exit\" button pressed"
        w31 = TRUE
        w32 = default
        w33 = w30
      }
      on "Window" Close? {
        call "Enqueue Message (Single).gvi"(priority message=TRUE, message queue in=w30, message="Exit") -> (message queue out=w33)
        Event Filter("Discard?"=TRUE)
        w31 = default
        w32 = default
      }
      on "Initialize VISA" Value changed {
        call "Enqueue Message (Single).gvi"(message queue in=w30, message="Initialize VISA") -> (message queue out=w33, error out=w32)
        w31 = default
      }
      on "Initialize AI" Value changed {
        call "Enqueue Message (Single).gvi"(message queue in=w30, message="Initialize AI") -> (message queue out=w33, error out=w32)
        w31 = default
      }
      on "CMD Button" Value changed {
        call "Enqueue Message (Single).gvi"(message queue in=w30, message="Send CMD") -> (message queue out=w33, error out=w32)
        w31 = default
      }
      on "TEMP Button" Value changed {
        call "Enqueue Message (Single).gvi"(message queue in=w30, message="Get Temperature") -> (message queue out=w33, error out=w32)
        w31 = default
      }
      on "LUX Button" Value changed {
        call "Enqueue Message (Single).gvi"(message queue in=w30, message="Get Brightness") -> (message queue out=w33, error out=w32)
        w31 = default
      }
      on "Reset CVM Button" Value changed {
        call "Enqueue Message (Single).gvi"(message queue in=w30, message="Reset CVM") -> (message queue out=w33, error out=w32)
        w31 = default
      }
      on "Panel Config Button" Value changed {
        call "Enqueue Message (Single).gvi"(message queue in=w30, message="Panel Config", message data=$"Panel Config Selector") -> (message queue out=w33, error out=w32)
        w31 = default
      }
      on "MV-Panel Configuration" Value changed {
        Event Data() -> ("New Value"=w34)
        call "Enqueue Message (Single).gvi"(message queue in=w30, message="PV Config", message data=w34) -> (message queue out=w33, error out=w32)
        w31 = default
      }
      on "Heat Button" Value changed {
        call "Enqueue Message (Single).gvi"(message queue in=w30, message="Heat Config", message data=$"Heat Selector") -> (message queue out=w33, error out=w32)
        w31 = default
      }
      on "MV-Heating" Value changed {
        Event Data() -> ("New Value"=w35)
        call "Enqueue Message (Single).gvi"(message queue in=w30, message="Heat Config", message data=w35) -> (message queue out=w33, error out=w32)
        w31 = default
      }
      on "Set PV Angle Button" Value changed {
        call "Enqueue Message (Single).gvi"(message queue in=w30, message="Set PV Angle", message data=$"PV Angle") -> (message queue out=w33, error out=w32)
        w31 = default
      }
      on "MV-Panel Tilt Angle" Value changed {
        Event Data() -> ("New Value"=w36)
        Decimal String To Number(string=w36) -> (offset past number=w37)
        call "Enqueue Message (Single).gvi"(message queue in=w30, message="Set PV Angle", message data=w37) -> (message queue out=w33, error out=w32)
        w31 = default
      }
      on "IR Thermometer Position" Value changed {
        call "Enqueue Message (Single).gvi"(message queue in=w30, message="IR Thermometer Position", message data=$"IR Thermometer Position Selector") -> (message queue out=w33, error out=w32)
        w31 = default
      }
      on "Fans Button" Value changed {
        call "Enqueue Message (Single).gvi"(message queue in=w30, message="Fans Control", message data=$"Fans Selector") -> (message queue out=w33, error out=w32)
        w31 = default
      }
      on "MV-Cooling" Value changed {
        Event Data() -> ("New Value"=w38)
        call "Enqueue Message (Single).gvi"(message queue in=w30, message="Fans Control", message data=w38) -> (message queue out=w33, error out=w32)
        w31 = default
      }
      on "Brightness Config Button" Value changed {
        call "Enqueue Message (Single).gvi"(message queue in=w30, message="Brightness Config", message data=$Brightness) -> (message queue out=w33, error out=w32)
        w31 = default
      }
      on "MV-Light Power" Value changed {
        Event Data() -> ("New Value"=w39)
        call "Enqueue Message (Single).gvi"(message queue in=w30, message="Brightness Config", message data=w39) -> (message queue out=w33, error out=w32)
        w31 = default
      }
      on "Optic Filter Config Button" Value changed {
        call "Enqueue Message (Single).gvi"(message queue in=w30, message="Optic Filter Config", message data=$"Optic Filter Selector") -> (message queue out=w33, error out=w32)
        w31 = default
      }
      on "MV-Optical Filter" Value changed {
        Event Data() -> ("New Value"=w40)
        call "Enqueue Message (Single).gvi"(message queue in=w30, message="Optic Filter Config", message data=w40) -> (message queue out=w33, error out=w32)
        w31 = default
      }
      on "Prepare CVM" Value changed {
        call "Enqueue Message (Single).gvi"(message queue in=w30, message="Prepare CVM") -> (message queue out=w33, error out=w32)
        w31 = default
      }
      on "Set LoadR" Value changed {
        Concatenate Strings($LoadR1, $LoadR10, $LoadR100, $LoadR1000) -> w41
        Is Empty String Or Path(string/path=$"Set LoadRTotal") -> w42
        Select(s=w42, t=w41, f=$"Set LoadRTotal") -> w43
        call "Enqueue Message (Single).gvi"(message queue in=w30, message="Set LoadR", message data=w43) -> (message queue out=w33, error out=w32)
        w31 = default
      }
      on "MV-LoadRTotal" Value changed {
        Concatenate Strings($LoadR1, $LoadR10, $LoadR100, $LoadR1000) -> w44
        call "Enqueue Message (Single).gvi"(message queue in=w30, message="Set LoadR", message data=w44) -> (message queue out=w33, error out=w32)
        w31 = default
      }
      on "No Load" Value changed {
        call "Enqueue Message (Single).gvi"(message queue in=w30, message="NoLoad") -> (message queue out=w33, error out=w32)
        w31 = default
      }
      on "VAC Button" Value changed {
        Property Node(instance in=reference to "VAC")
        Get Current Time() -> (current time=w45)
        call "Enqueue Message (Single).gvi"(message queue in=w30, message="VAC", message data=w45) -> (message queue out=w33)
        $"VAC Load Counter" <- 0
        w31 = default
        w32 = default
      }
    }
    call "Error Handler - Event Handling Loop.gvi"(message queue in=w33, error in=w32) -> (dup error in=w46)
    stop if w31
  }
  Unregister For Events(error in=w46, event registration refnum=s2)
  $"API Key" <- "zYUbuW0YNkg1G__lXfJiGVBNWME-HlVd2a5NUHp-IP"
  s3 = "UI Data.gtype" {all zero or empty}  # shift register
  s4 = T1 {"VISA Resource"="COM5", "Physical Channel"=""}  # shift register
  while {
    call "Dequeue Message.gvi"(message queue in=w30, error in=w29) -> (message queue out=w47, message=w48, message data=w49, error out=w50)
    $"Hardware Current Status" <- w48
    # s3: Data
    # s4: VISA
    # w26: Stop Event
    case (w48) ignore case {  # Message Cases
      frame "Initialize" {
        call "Enqueue Message (Single).gvi"(message queue in=w47, message="Initialize VISA", error in=w50) -> (message queue out=w55, error out=w56)
        call "Enqueue Message (Single).gvi"(message queue in=w55, message="Initialize AI", error in=w56) -> (message queue out=w57, error out=w58)
        call "Enqueue Message (Single).gvi"(message queue in=w57, message="Set Arduino Status", error in=w58) -> (message queue out=w59, error out=w60)
        call "Enqueue Message (Single).gvi"(message queue in=w59, message="Reset CVM", error in=w60) -> (message queue out=w61, error out=w62)
        call "Enqueue Message (Single).gvi"(message queue in=w61, message="NoLoad", error in=w62) -> (message queue out=w63, error out=w64)
        call "Enqueue Message (Single).gvi"(message queue in=w63, message="Brightness Config", message data=2, error in=w64) -> (message queue out=w65, error out=w66)
        call "Enqueue Message (Single).gvi"(message queue in=w65, message="Fans Control", message data="0", error in=w66) -> (message queue out=w67, error out=w68)
        call "Enqueue Message (Single).gvi"(message queue in=w67, message="Heat Config", message data="0", error in=w68) -> (message queue out=w69, error out=w70)
        call "Enqueue Message (Single).gvi"(message queue in=w69, message="Optic Filter Config", message data="No Filter", error in=w70) -> (message queue out=w71, error out=w72)
        call "Enqueue Message (Single).gvi"(message queue in=w71, message="IR Thermometer Position", message data="None", error in=w72) -> (message queue out=w73, error out=w74)
        call "Enqueue Message (Single).gvi"(message queue in=w73, message="Set PV Angle", message data=90, error in=w74) -> (message queue out=w75, error out=w76)
        call "Enqueue Message (Single).gvi"(message queue in=w75, message="Panel Config", message data="Parallel 4", error in=w76) -> (message queue out=w77, error out=w78)
        call "Enqueue Message (Single).gvi"(message queue in=w77, message="Wait For Event", error in=w78) -> (error out=w51)
        Build Array(reference to "Arduino Status", reference to "TempSensor Error", reference to "LuxSensor Error", reference to "Set LoadRTotal") -> w79
        for {
          w80 = each element of w79
          Property Node(instance in=w80, "Value"="none")
        }
        Build Array(reference to "TempSensor", reference to "LuxSensor", reference to "Recalculated Voltage", reference to "Voltage EndPoint", reference to "Voltage MidPoint", reference to "Recalculated Current", reference to "Current EndPoint", reference to "Current MidPoint", reference to "V Coeff", reference to "C Coeff") -> w81
        for {
          w82 = each element of w81
          Property Node(instance in=w82, "Value"=-1)
        }
        w52 = s3
        w53 = default
        w54 = s4
      }
      frame "Initialize VISA" {
        call "Configure Serial Port (Instr).gvi"(stop bits="1.0"(10), session in=$"VISA Resource Name", error in=w50, baud rate=115200, parity="None"(0), termination char=0xA, enable termination char=TRUE) -> (session out=w83, error out=w84)
        call "Open (Instr).gvi"(resource name=w83, error in=w84) -> (session out=w85, error out=w51)
        Property Node(instance in=s4, "VISA Resource"=w85) -> (instance out=w54)
        Wait(time to wait=2000)
        w52 = s3
        w53 = default
      }
      frame "Initialize AI" {
        call "DAQmx Create Channel (AI-Voltage-Basic).gvi"(error in=w50, physical channels="Dev1/ai0:1,Dev1/ai3,Dev1/ai7,Dev1/ai6", units="Volts"(10348), measurement range="ValueRange.gtype" {"maximum value"=10, "minimum value"=0}, input terminal configuration="RSE"(10083)) -> (task out=w86, error out=w51)
        Property Node(instance in=s4, "Physical Channel"=w86) -> (instance out=w54)
        w52 = s3
        w53 = default
      }
      frame "Wait For Event" {
        Wait(time to wait=100)
        call "Enqueue Message (Single).gvi"(message queue in=w47, message="Watchdog", error in=w50) -> (error out=w51)
        w52 = s3
        w53 = default
        w54 = s4
      }
      frame "Send CMD" {
        Property Node(instance in=s4) -> ("VISA Resource"=w87, instance out=w54)
        call "Enqueue Message (Single).gvi"(message queue in=w47, message="Wait For Event", error in=w50) -> (error out=w88)
        call "VISA ReadWrite.gvi"(VISA_IN=w87, CMD=$"Command to Arduino", ERROR_IN=w88) -> (Arduino_Reply=w89, ERROR_OUT=w51)
        $"Command reply" <- w89
        w52 = s3
        w53 = default
      }
      frame "Set Arduino Status" {
        Property Node(instance in=s4) -> ("VISA Resource"=w90, instance out=w54)
        call "VISA ReadWrite.gvi"(VISA_IN=w90, CMD="@TIME 10 CEPHEI#", ERROR_IN=w50) -> (ERROR_OUT=w51)
        w52 = s3
        w53 = default
      }
      frame "Watchdog" {
        Property Node(instance in=s4) -> ("Physical Channel"=w91, "VISA Resource"=w92, instance out=w54)
        call "VISA ReadWrite.gvi"(VISA_IN=w92, CMD="@TIME 10 ?#", ERROR_IN=w50) -> (OUTPUT=w93, Arduino_Reply=w94, ERROR_OUT=w95)
        Property Node(instance in=w94) -> ("DATA"=w96)
        call "VISA Reply Parse.gvi"(string=w96) -> (Reply String=w97)
        Match Pattern(regular expression="CEPHEI", string=w97) -> (match substring=w98)
        Is Equal(x=w98, y="CEPHEI") -> w99
        case (w99) {
          frame False, Default {
            call "Enqueue Message (Single).gvi"(message queue in=w47, message="Initialize", error in=w95) -> (error out=w51)
          }
          frame True {
            call "VISA ReadWrite.gvi"(VISA_IN=w93, CMD="@LUX 10 1#", ERROR_IN=w95) -> (OUTPUT=w100, Arduino_Reply=w101, ERROR_OUT=w102)
            call "VISA ReadWrite.gvi"(VISA_IN=w100, CMD="@TEMP 8 0#", ERROR_IN=w102) -> (Arduino_Reply=w103, ERROR_OUT=w104)
            call "DAQmx Read (Analog 2D DBL NChan NSamp).gvi"(task in=w91, error in=w104, number of samples per channel=1) -> (error out=w105, data=w106)
            Array Index(array=w106) -> (out0[4, 0]=w107)
            Multiply(w107, 10) -> w108
            $"TempSensor IR" <- w108
            Array Index(array=w106) -> (out0[1, 0]=w109, out1[2, 0]=w110)
            Multiply(w109, 4) -> w111
            Multiply(w111, $"V Coeff") -> w112
            Feedback Node(input=w113) -> w114
            Build Array(w114, w112) -> w113
            $Voltage_Graph <- w113
            $"Recalculated Voltage" <- w112
            $"Voltage EndPoint" <- w109
            $"Voltage MidPoint" <- w110
            Array Index(array=w106) -> (out0[0, 0]=w115, out1[3, 0]=w116)
            Divide(x=w115, y=70) -> w117
            Multiply(w117, 1000) -> w118
            Multiply(w118, $"C Coeff") -> w119
            Feedback Node(input=w120) -> w121
            Build Array(w121, w119) -> w120
            $Current_Graph <- w120
            $"Recalculated Current" <- w119
            $"Current EndPoint" <- w115
            $"Current MidPoint" <- w116
            call "DAQmx Read (Analog 1D Wfm NChan NSamp).gvi"(task in=w91, error in=w105, number of samples per channel=1) -> (error out=w122, data=w123)
            call "Enqueue Message (Single).gvi"(message queue in=w47, message="Wait For Event", error in=w122) -> (error out=w51)
            $"AI measurements" <- w123
            Property Node(instance in=reference to "PV-Current, mA", "Value"=w119)
            Property Node(instance in=w101) -> ("DATA"=w124, instance out=w125)
            $"LUXSensor Reply" <- w125
            Property Node(instance in=w103) -> ("DATA"=w126, instance out=w127)
            $"TempSensor Reply" <- w127
            Property Node(instance in=reference to "PV-Voltage, V", "Value"=w112)
            call "VISA Reply Parse.gvi"(string=w124) -> (Error code=w128, Reply=w129)
            Property Node(instance in=reference to "PV-LightIntensity, W/m2", "Value"=w129)
            call "VISA Reply Parse.gvi"(string=w126) -> (Error code=w130, Reply=w131)
            Property Node(instance in=$"Measured Data", "Voltage, V"=w112, "Current, mA"=w119, "Luminous Flux, Lux"=w129, "Temperature, GradC"=w131, "Temperature IR, GradC"=w108) -> (instance out=w132)
            $"Measured Data" <- w132
            $"LuxSensor Error" <- w128
            $"TempSensor Error" <- w130
            Property Node(instance in=reference to "PV-Temperature, ºC", "Value"=w131)
            $LuxSensor <- w129
            $TempSensor <- w131
          }
        }
        $"Arduino Status" <- w97
        w52 = s3
        w53 = default
      }
      frame "Panel Config" {
        Property Node(instance in=s4) -> ("VISA Resource"=w133, instance out=w54)
        Variant To Data(error in (no error)=w50, type=string "", variant=w49) -> (data=w134, error out=w135)
        call "Panel Switch.gvi"(VISA_IN=w133, CTRL="Disconnect", ERROR_IN=w135) -> (VISA_OUT=w136, ERROR_OUT=w137)
        case (w134) {
          frame "Single" {
            w140 = ["@DO 17 0#", "@DO 18 1#", "@DO 23 1#", "@DO 24 1#", "@DO 25 1#", "@DO 26 0#", "@DO 27 0#", "@DO 28 0#", "@DO 29 1#", "@DO 30 1#", "@DO 31 1#", "@DO 32 1#", "@DO 33 0#"]
            w141 = ["@DO 54 1#", "@DO 55 1#", "@DO 56 1#", "@DO 57 1#", "@DO 58 1#", "@DO 59 1#", "@DO 60 1#", "@DO 61 1#"]
            # @DO 17 0#
            # @DO 18 1#
            # @DO 23 1#
            # @DO 24 1#
            # @DO 25 1#
            # @DO 26 0#
            # @DO 27 0#
            # @DO 28 0#
            # @DO 29 1#
            # @DO 30 1#
            # @DO 31 1#
            # @DO 32 1#
            # @DO 33 0#
            #
            # 03,08,2020
            # 19:51
            Insert Into Array(inArray=w140, new=w141) -> w142
            call "VISA Multiple Write.gvi"(VISA_IN=w136, ARRAY_IN=w142, ERROR_IN=w137) -> (ERROR_OUT=w138)
            w139 = w134
          }
          frame "Parallel 2" {
            # @DO 17 1#
            # @DO 18 0#
            # @DO 23 1#
            # @DO 24 0#
            # @DO 25 1#
            # @DO 26 1#
            # @DO 27 1#
            # @DO 28 1#
            # @DO 29 1#
            # @DO 30 1#
            # @DO 31 1#
            # @DO 32 1#
            # @DO 33 1#
            #
            # 03.08.2020
            # 19.53
            w143 = ["@DO 17 1#", "@DO 18 0#", "@DO 23 1#", "@DO 24 0#", "@DO 25 1#", "@DO 26 1#", "@DO 27 1#", "@DO 28 1#", "@DO 29 1#", "@DO 30 1#", "@DO 31 1#", "@DO 32 1#", "@DO 33 1#"]
            # Disconnect all Diodes
            w144 = ["@DO 54 1#", "@DO 55 1#", "@DO 56 1#", "@DO 57 1#", "@DO 58 1#", "@DO 59 1#", "@DO 60 1#", "@DO 61 1#"]
            Insert Into Array(inArray=w143, new=w144) -> w145
            call "VISA Multiple Write.gvi"(VISA_IN=w136, ARRAY_IN=w145, ERROR_IN=w137) -> (ERROR_OUT=w138)
            w139 = w134
          }
          frame "Parallel 2 Diode" {
            # @DO 17 1#
            # @DO 18 0#
            # @DO 23 1#
            # @DO 24 0#
            # @DO 25 1#
            # @DO 26 1#
            # @DO 27 1#
            # @DO 28 1#
            # @DO 29 1#
            # @DO 30 1#
            # @DO 31 1#
            # @DO 32 1#
            # @DO 33 1#
            #
            # 03.08.2020
            # 19.54
            w146 = ["@DO 17 1#", "@DO 18 0#", "@DO 23 1#", "@DO 24 0#", "@DO 25 1#", "@DO 26 1#", "@DO 27 1#", "@DO 28 1#", "@DO 29 1#", "@DO 30 1#", "@DO 31 1#", "@DO 32 1#", "@DO 33 1#"]
            # @DO 56 0#
            # @DO 57 0#
            #
            # 19.54
            w147 = ["@DO 54 1#", "@DO 55 1#", "@DO 56 0#", "@DO 57 0#", "@DO 58 1#", "@DO 59 1#", "@DO 60 1#", "@DO 61 1#"]
            Insert Into Array(inArray=w146, new=w147) -> w148
            call "VISA Multiple Write.gvi"(VISA_IN=w136, ARRAY_IN=w148, ERROR_IN=w137) -> (ERROR_OUT=w138)
            w139 = w134
          }
          frame "Series 2" {
            # @DO 17 0#
            # @DO 18 1#
            # @DO 23 1#
            # @DO 24 0#
            # @DO 25 1#
            # @DO 26 1#
            # @DO 27 1#
            # @DO 28 1#
            # @DO 29 0#
            # @DO 30 1#
            # @DO 31 1#
            # @DO 32 0#
            # @DO 33 0#
            #
            # 03.08.2020
            # 19.55
            w149 = ["@DO 17 0#", "@DO 18 1#", "@DO 23 1#", "@DO 24 0#", "@DO 25 1#", "@DO 26 1#", "@DO 27 1#", "@DO 28 1#", "@DO 29 0#", "@DO 30 1#", "@DO 31 1#", "@DO 32 0#", "@DO 33 0#"]
            w150 = ["@DO 54 1#", "@DO 55 1#", "@DO 56 1#", "@DO 57 1#", "@DO 58 1#", "@DO 59 1#", "@DO 60 1#", "@DO 61 1#"]
            Insert Into Array(inArray=w149, new=w150) -> w151
            call "VISA Multiple Write.gvi"(VISA_IN=w136, ARRAY_IN=w151, ERROR_IN=w137) -> (ERROR_OUT=w138)
            w139 = w134
          }
          frame "Series 2 Diode" {
            # @DO 17 0#
            # @DO 18 1#
            # @DO 23 1#
            # @DO 24 0#
            # @DO 25 1#
            # @DO 26 1#
            # @DO 27 1#
            # @DO 28 1#
            # @DO 29 0#
            # @DO 30 1#
            # @DO 31 1#
            # @DO 32 0#
            # @DO 33 0#
            #
            # 03.08.2020
            # 19.57
            w152 = ["@DO 17 0#", "@DO 18 1#", "@DO 23 1#", "@DO 24 0#", "@DO 25 1#", "@DO 26 1#", "@DO 27 1#", "@DO 28 1#", "@DO 29 0#", "@DO 30 1#", "@DO 31 1#", "@DO 32 0#", "@DO 33 0#"]
            # @DO 60 0#
            # @DO 61 0#
            #
            # 03.08.2020
            w153 = ["@DO 54 1#", "@DO 55 1#", "@DO 56 1#", "@DO 57 1#", "@DO 58 1#", "@DO 59 1#", "@DO 60 0#", "@DO 61 0#"]
            Insert Into Array(inArray=w152, new=w153) -> w154
            call "VISA Multiple Write.gvi"(VISA_IN=w136, ARRAY_IN=w154, ERROR_IN=w137) -> (ERROR_OUT=w138)
            w139 = w134
          }
          frame "Parallel 4", Default {
            # @DO 17 1#
            # @DO 18 1#
            # @DO 23 1#
            # @DO 24 1#
            # @DO 25 1#
            # @DO 26 1#
            # @DO 27 1#
            # @DO 28 1#
            # @DO 29 1#
            # @DO 30 1#
            # @DO 31 1#
            # @DO 32 1#
            # @DO 33 1#
            #
            # 03.08.2020
            # 19.59
            w155 = ["@DO 17 1#", "@DO 18 1#", "@DO 23 1#", "@DO 24 1#", "@DO 25 1#", "@DO 26 1#", "@DO 27 1#", "@DO 28 1#", "@DO 29 1#", "@DO 30 1#", "@DO 31 1#", "@DO 32 1#", "@DO 33 1#"]
            w156 = ["@DO 54 1#", "@DO 55 1#", "@DO 56 1#", "@DO 57 1#", "@DO 58 1#", "@DO 59 1#", "@DO 60 1#", "@DO 61 1#"]
            Insert Into Array(inArray=w155, new=w156) -> w157
            call "VISA Multiple Write.gvi"(VISA_IN=w136, ARRAY_IN=w157, ERROR_IN=w137) -> (ERROR_OUT=w138)
            w139 = "Parallel 4"
          }
          frame "Parallel 4 Diode" {
            # @DO 17 1#
            # @DO 18 1#
            # @DO 23 1#
            # @DO 24 1#
            # @DO 25 1#
            # @DO 26 1#
            # @DO 27 1#
            # @DO 28 1#
            # @DO 29 1#
            # @DO 30 1#
            # @DO 31 1#
            # @DO 32 1#
            # @DO 33 1#
            # 03.08.2020
            # 20.00
            w158 = ["@DO 17 1#", "@DO 18 1#", "@DO 23 1#", "@DO 24 1#", "@DO 25 1#", "@DO 26 1#", "@DO 27 1#", "@DO 28 1#", "@DO 29 1#", "@DO 30 1#", "@DO 31 1#", "@DO 32 1#", "@DO 33 1#"]
            # @DO 54 0#
            # @DO 55 0#
            # @DO 56 0#
            # @DO 57 0#
            #
            # 03.08.2020
            # 20.00
            w159 = ["@DO 54 0#", "@DO 55 0#", "@DO 56 0#", "@DO 57 0#", "@DO 58 1#", "@DO 59 1#", "@DO 60 1#", "@DO 61 1#"]
            Insert Into Array(inArray=w158, new=w159) -> w160
            call "VISA Multiple Write.gvi"(VISA_IN=w136, ARRAY_IN=w160, ERROR_IN=w137) -> (ERROR_OUT=w138)
            w139 = w134
          }
          frame "Series 4" {
            # @DO 17 0#
            # @DO 18 1#
            # @DO 23 0#
            # @DO 24 1#
            # @DO 25 1#
            # @DO 26 0#
            # @DO 27 0#
            # @DO 28 0#
            # @DO 29 0#
            # @DO 30 0#
            # @DO 31 0#
            # @DO 32 0#
            # @DO 33 0#
            #
            # 03.08.2020
            # 20.02
            w161 = ["@DO 17 0#", "@DO 18 1#", "@DO 23 0#", "@DO 24 1#", "@DO 25 1#", "@DO 26 0#", "@DO 27 0#", "@DO 28 0#", "@DO 29 0#", "@DO 30 0#", "@DO 31 0#", "@DO 32 0#", "@DO 33 0#"]
            w162 = ["@DO 54 1#", "@DO 55 1#", "@DO 56 1#", "@DO 57 1#", "@DO 58 1#", "@DO 59 1#", "@DO 60 1#", "@DO 61 1#"]
            Insert Into Array(inArray=w161, new=w162) -> w163
            call "VISA Multiple Write.gvi"(VISA_IN=w136, ARRAY_IN=w163, ERROR_IN=w137) -> (ERROR_OUT=w138)
            w139 = w134
          }
          frame "Series 4 Diode" {
            # @DO 17 0#
            # @DO 18 1#
            # @DO 23 0#
            # @DO 24 1#
            # @DO 25 1#
            # @DO 26 0#
            # @DO 27 0#
            # @DO 28 0#
            # @DO 29 0#
            # @DO 30 0#
            # @DO 31 0#
            # @DO 32 0#
            # @DO 33 0#
            #
            # 03.08.2020
            # 20.03
            w164 = ["@DO 17 0#", "@DO 18 1#", "@DO 23 0#", "@DO 24 1#", "@DO 25 1#", "@DO 26 0#", "@DO 27 0#", "@DO 28 0#", "@DO 29 0#", "@DO 30 0#", "@DO 31 0#", "@DO 32 0#", "@DO 33 0#"]
            # @DO 58 0#
            # @DO 59 0#
            # @DO 60 0#
            # @DO 61 0#
            #
            # 03.08.2020
            # 20.04
            w165 = ["@DO 54 1#", "@DO 55 1#", "@DO 56 1#", "@DO 57 1#", "@DO 58 0#", "@DO 59 0#", "@DO 60 0#", "@DO 61 0#"]
            Insert Into Array(inArray=w164, new=w165) -> w166
            call "VISA Multiple Write.gvi"(VISA_IN=w136, ARRAY_IN=w166, ERROR_IN=w137) -> (ERROR_OUT=w138)
            w139 = w134
          }
          frame "Parallel Of Series" {
            # @DO 17 1#
            # @DO 18 1#
            # @DO 23 1#
            # @DO 24 1#
            # @DO 25 1#
            # @DO 26 1#
            # @DO 27 0#
            # @DO 28 1#
            # @DO 29 0#
            # @DO 30 0#
            # @DO 31 1#
            # @DO 32 0#
            # @DO 33 1#
            #
            # 03.08.2020
            # 20.05
            w167 = ["@DO 17 1#", "@DO 18 1#", "@DO 23 1#", "@DO 24 1#", "@DO 25 1#", "@DO 26 1#", "@DO 27 0#", "@DO 28 1#", "@DO 29 0#", "@DO 30 0#", "@DO 31 1#", "@DO 32 0#", "@DO 33 1#"]
            w168 = ["@DO 54 1#", "@DO 55 1#", "@DO 56 1#", "@DO 57 1#", "@DO 58 1#", "@DO 59 1#", "@DO 60 1#", "@DO 61 1#"]
            Insert Into Array(inArray=w167, new=w168) -> w169
            call "VISA Multiple Write.gvi"(VISA_IN=w136, ARRAY_IN=w169, ERROR_IN=w137) -> (ERROR_OUT=w138)
            w139 = w134
          }
          frame "Parallel Of Series Diode" {
            # @DO 17 1#
            # @DO 18 1#
            # @DO 23 1#
            # @DO 24 1#
            # @DO 25 1#
            # @DO 26 1#
            # @DO 27 0#
            # @DO 28 1#
            # @DO 29 0#
            # @DO 30 0#
            # @DO 31 1#
            # @DO 32 0#
            # @DO 33 1#
            #
            # 03.08.2020
            # 20.06
            # @DO 58 0#
            # @DO 59 0#
            # @DO 60 0#
            # @DO 61 0#
            #
            # 03.08.2020
            # 20.097
            w170 = ["@DO 17 1#", "@DO 18 1#", "@DO 23 1#", "@DO 24 1#", "@DO 25 1#", "@DO 26 1#", "@DO 27 0#", "@DO 28 1#", "@DO 29 0#", "@DO 30 0#", "@DO 31 1#", "@DO 32 0#", "@DO 33 1#"]
            w171 = ["@DO 54 1#", "@DO 55 1#", "@DO 56 1#", "@DO 57 1#", "@DO 58 0#", "@DO 59 0#", "@DO 60 0#", "@DO 61 0#"]
            Insert Into Array(inArray=w170, new=w171) -> w172
            call "VISA Multiple Write.gvi"(VISA_IN=w136, ARRAY_IN=w172, ERROR_IN=w137) -> (ERROR_OUT=w138)
            w139 = w134
          }
          frame "Series Of Parallel" {
            w173 = ["@DO 54 1#", "@DO 55 1#", "@DO 56 1#", "@DO 57 1#", "@DO 58 1#", "@DO 59 1#", "@DO 60 1#", "@DO 61 1#"]
            # @DO 17 1#
            # @DO 18 0#
            # @DO 23 0#
            # @DO 24 0#
            # @DO 25 0#
            # @DO 26 1#
            # @DO 27 1#
            # @DO 28 1#
            # @DO 29 1#
            # @DO 30 1#
            # @DO 31 1#
            # @DO 32 1#
            # @DO 33 1#
            #
            # 03.08.2020
            # 20.07
            w174 = ["@DO 17 1#", "@DO 18 0#", "@DO 23 0#", "@DO 24 0#", "@DO 25 0#", "@DO 26 1#", "@DO 27 1#", "@DO 28 1#", "@DO 29 1#", "@DO 30 1#", "@DO 31 1#", "@DO 32 1#", "@DO 33 1#"]
            Insert Into Array(inArray=w174, new=w173) -> w175
            call "VISA Multiple Write.gvi"(VISA_IN=w136, ARRAY_IN=w175, ERROR_IN=w137) -> (ERROR_OUT=w138)
            w139 = w134
          }
          frame "Series Of Parallel Diode" {
            # @DO 17 1#
            # @DO 18 0#
            # @DO 23 0#
            # @DO 24 0#
            # @DO 25 0#
            # @DO 26 1#
            # @DO 27 1#
            # @DO 28 1#
            # @DO 29 1#
            # @DO 30 1#
            # @DO 31 1#
            # @DO 32 1#
            # @DO 33 1#
            #
            # 03.08.2020
            # 20.08
            w176 = ["@DO 17 1#", "@DO 18 0#", "@DO 23 0#", "@DO 24 0#", "@DO 25 0#", "@DO 26 1#", "@DO 27 1#", "@DO 28 1#", "@DO 29 1#", "@DO 30 1#", "@DO 31 1#", "@DO 32 1#", "@DO 33 1#"]
            # @DO 54 0#
            # @DO 55 0#
            # @DO 56 0#
            # @DO 57 0#
            #
            # 20.09
            # 03.08.2020
            w177 = ["@DO 54 0#", "@DO 55 0#", "@DO 56 0#", "@DO 57 0#", "@DO 58 1#", "@DO 59 1#", "@DO 60 1#", "@DO 61 1#"]
            Insert Into Array(inArray=w176, new=w177) -> w178
            call "VISA Multiple Write.gvi"(VISA_IN=w136, ARRAY_IN=w178, ERROR_IN=w137) -> (ERROR_OUT=w138)
            w139 = w134
          }
        }
        call "Panel Switch.gvi"(VISA_IN=w133, CTRL="Connect", ERROR_IN=w138) -> (ERROR_OUT=w51)
        Property Node(instance in=reference to "PV-Panel Cofiguration", "ValueSignaling"=w139)
        w52 = s3
        w53 = default
      }
      frame "Prepare CVM" {
        Property Node(instance in=s4) -> ("VISA Resource"=w179, "Physical Channel"=w180, instance out=w54)
        call "DAQmx Read (Analog 2D DBL NChan NSamp).gvi"(task in=w180, error in=w50, number of samples per channel=1) -> (error out=w181, data=w182)
        Array Index(array=w182) -> (out0[2, 0]=w183)
        Multiply(w183, 4) -> w184
        C Code Node("x"=w184, Error In=w181) -> ("y"=w185, Error Out=w186)
        ~~~
        if(x>-1 && x<=1)
          y = 0;
        if(x>1 && x<=10)
          y = 3;
        if(x>10 && x<=20)
          y = 2;
        if(x>20 && x<=30)
          y = 1;
        ~~~
        Array Index(array=w182) -> (out0[3, 0]=w187)
        # Tip For Local Wiring Solution
        # Relay 1(50) 	DO 1- REP A x1
        # 		DO 0- AMP A x10
        #
        # Relay 2(51) 	DO 1-REP V x1
        # 		DO 0-DIV V x0.25
        # Relay 3(52) 	DO 1-REP V x1
        # 		DO 0-DIV V x0.5
        # Relay 4(53) 	DO 1-REP V x1
        # 		DO 0-AMP V x10
        C Code Node("x"=w187, Error In=w186) -> ("y"=w188, Error Out=w189)
        ~~~
        if(x>-1 && x<=0.6)
          y = 0;
        if(x>0.6 && x<=6)
          y = 1;
        ~~~
        # Voltage Range
        case (w185) {
          frame 0, Default {
            call "VISA Multiple Write.gvi"(VISA_IN=w179, ARRAY_IN=["@DO 51 1#", "@DO 52 1#", "@DO 53 0#"], ERROR_IN=w189) -> (VISA Answer=w192, ERROR_OUT=w190)
            w191 = 0.1
          }
          frame 1 {
            call "VISA Multiple Write.gvi"(VISA_IN=w179, ARRAY_IN=["@DO 51 1#", "@DO 52 1#", "@DO 53 1#"], ERROR_IN=w189) -> (VISA Answer=w192, ERROR_OUT=w190)
            w191 = 1
          }
          frame 2 {
            call "VISA Multiple Write.gvi"(VISA_IN=w179, ARRAY_IN=["@DO 51 1#", "@DO 52 0#", "@DO 53 1#"], ERROR_IN=w189) -> (VISA Answer=w192, ERROR_OUT=w190)
            w191 = 0.5
          }
          frame 3 {
            # Div x0.25 works with 2 relay
            call "VISA Multiple Write.gvi"(VISA_IN=w179, ARRAY_IN=["@DO 51 0#", "@DO 52 0#", "@DO 53 1#"], ERROR_IN=w189) -> (VISA Answer=w192, ERROR_OUT=w190)
            w191 = 0.25
          }
        }
        $"V Coeff" <- w191
        $"VISA Answer_2" <- w192
        # Current Range
        case (w188) {
          frame 0, Default {
            call "VISA Multiple Write.gvi"(VISA_IN=w179, ARRAY_IN=["@DO 50 0#"], ERROR_IN=w190) -> (ERROR_OUT=w51)
            w193 = 0.1
          }
          frame 1 {
            call "VISA Multiple Write.gvi"(VISA_IN=w179, ARRAY_IN=["@DO 50 1#"], ERROR_IN=w190) -> (ERROR_OUT=w51)
            w193 = 1
          }
        }
        $"C Coeff" <- w193
        w52 = s3
        w53 = default
      }
      frame "Reset CVM" {
        $"V Coeff" <- 1
        $"C Coeff" <- 1
        Property Node(instance in=s4) -> ("VISA Resource"=w194, instance out=w54)
        # VOLTAGE RANGE
        # @DO 51 0#
        # @DO 52 0#
        # @DO 53 0#
        call "VISA Multiple Write.gvi"(VISA_IN=w194, ARRAY_IN=["@DO 51 1#", "@DO 52 1#", "@DO 53 1#"], ERROR_IN=w50) -> (VISA_OUT=w195, ERROR_OUT=w196)
        # CURRENT RANGE
        # @DO 50 1#
        call "VISA Multiple Write.gvi"(VISA_IN=w195, ARRAY_IN=["@DO 50 1#"], ERROR_IN=w196) -> (ERROR_OUT=w51)
        w52 = s3
        w53 = default
      }
      frame "VAC" {
        w197 = ["0", "1,", "10,", "20,10,", "50,", "50,20,", "100,", "100,40,10,", "200,100,", "500,100,", "1000,", "2000,", "2000,1000,", "4000,", "4000,1000,", "4000,2000,", "4000,2000,1000,", "4000,2000,1000,500,400,100,"]
        Array Size(array=w197) -> (size(s)=w198)
        Is Less Or Equal(x=$"VAC Load Counter", y=w198) -> w199
        Property Node(instance in=s4) -> ("VISA Resource"=w200, "Physical Channel"=w201, instance out=w54)
        Variant To Data(type=timestamp 1904-01-01T00:00:00Z, variant=w49) -> (data=w202)
        Get Current Time() -> (current time=w203)
        Timestamp Subtract(x=w203, y=w202) -> w204
        Is Greater Or Equal(x=w204, y=5) -> w205
        Logical And(w205, w199) -> w206
        case (w206) {
          frame False, Default {
            w207 = w50
            w208 = w202
            w209 = $"VAC Load Counter"
          }
          frame True {
            Get Current Time() -> (current time=w208)
            # Disconnect ALL load
            Array Index(array=w197) -> (out0[$"VAC Load Counter"]=w210)
            w211 = ["@DO 42 1#", "@DO 34 0#", "@DO 35 0#", "@DO 36 0#", "@DO 37 0#", "@DO 38 0#", "@DO 39 0#", "@DO 40 0#", "@DO 41 0#", "@DO 43 0#", "@DO 44 0#", "@DO 45 0#", "@DO 46 0#", "@DO 47 0#", "@DO 48 0#", "@DO 49 0#"]
            call "VISA Multiple Write.gvi"(VISA_IN=w200, ARRAY_IN=w211, ERROR_IN=w50) -> (ERROR_OUT=w212)
            s5 = w210  # shift register
            while {
              Match Pattern(regular expression=",", string=s5) -> (after substring=w213, before substring=w214)
              case (w214) {
                frame "1" {
                  call "VISA ReadWrite.gvi"(VISA_IN=w200, CMD="@DO 43 1#", ERROR_IN=w212) -> (ERROR_OUT=w215)
                }
                frame "2" {
                  call "VISA ReadWrite.gvi"(VISA_IN=w200, CMD="@DO 44 1#", ERROR_IN=w212) -> (ERROR_OUT=w215)
                }
                frame "3" {
                  call "VISA ReadWrite.gvi"(VISA_IN=w200, CMD="@DO 45 1#", ERROR_IN=w212) -> (ERROR_OUT=w215)
                }
                frame "5" {
                  call "VISA ReadWrite.gvi"(VISA_IN=w200, CMD="@DO 46 1#", ERROR_IN=w212) -> (ERROR_OUT=w215)
                }
                frame "10" {
                  call "VISA ReadWrite.gvi"(VISA_IN=w200, CMD="@DO 47 1#", ERROR_IN=w212) -> (ERROR_OUT=w215)
                }
                frame "20" {
                  call "VISA ReadWrite.gvi"(VISA_IN=w200, CMD="@DO 48 1#", ERROR_IN=w212) -> (ERROR_OUT=w215)
                }
                frame "40" {
                  call "VISA ReadWrite.gvi"(VISA_IN=w200, CMD="@DO 49 1#", ERROR_IN=w212) -> (ERROR_OUT=w215)
                }
                frame "50" {
                  call "VISA ReadWrite.gvi"(VISA_IN=w200, CMD="@DO 34 1#", ERROR_IN=w212) -> (ERROR_OUT=w215)
                }
                frame "100" {
                  call "VISA ReadWrite.gvi"(VISA_IN=w200, CMD="@DO 35 1#", ERROR_IN=w212) -> (ERROR_OUT=w215)
                }
                frame "200" {
                  call "VISA ReadWrite.gvi"(VISA_IN=w200, CMD="@DO 36 1#", ERROR_IN=w212) -> (ERROR_OUT=w215)
                }
                frame "400" {
                  call "VISA ReadWrite.gvi"(VISA_IN=w200, CMD="@DO 37 1#", ERROR_IN=w212) -> (ERROR_OUT=w215)
                }
                frame "500" {
                  call "VISA ReadWrite.gvi"(VISA_IN=w200, CMD="@DO 38 1#", ERROR_IN=w212) -> (ERROR_OUT=w215)
                }
                frame "1000" {
                  call "VISA ReadWrite.gvi"(VISA_IN=w200, CMD="@DO 39 1#", ERROR_IN=w212) -> (ERROR_OUT=w215)
                }
                frame "2000" {
                  call "VISA ReadWrite.gvi"(VISA_IN=w200, CMD="@DO 40 1#", ERROR_IN=w212) -> (ERROR_OUT=w215)
                }
                frame "4000" {
                  call "VISA ReadWrite.gvi"(VISA_IN=w200, CMD="@DO 41 1#", ERROR_IN=w212) -> (ERROR_OUT=w215)
                }
                frame "0", Default {
                  # Для измерения тока К.З.
                  # Схема сопротивления
                  # 1 Ом + 1 Ом токовый резистор
                  w215 = w212
                }
              }
              Is Empty String Or Path(string/path=w213) -> w216
              next s5 = w213
              stop if w216
            }
            call "VISA ReadWrite.gvi"(VISA_IN=w200, CMD="@DO 42 0#", ERROR_IN=w215) -> (ERROR_OUT=w207)
            Increment(x=$"VAC Load Counter") -> w209
          }
        }
        call "Enqueue Message (Single).gvi"(message queue in=w47, message="Watchdog", error in=w207) -> (message queue out=w217, error out=w218)
        case (w199) {
          frame False, Default {
            call "Enqueue Message (Single).gvi"(message queue in=w217, message="NoLoad", error in=w218) -> (error out=w51)
          }
          frame True {
            call "Enqueue Message (Single).gvi"(message queue in=w217, message="VAC", message data=w208, error in=w218) -> (error out=w51)
          }
        }
        $"VAC Load Counter" <- w209
        call "DAQmx Read (Analog 2D DBL NChan NSamp).gvi"(task in=w201, number of samples per channel=1) -> (data=w219)
        Array Index(array=w219) -> (out0[1, 0]=w220)
        Multiply(w220, 4) -> w221
        Feedback Node(input=w222) -> w223
        Build Array(w223, w221) -> w222
        Array Index(array=w219) -> (out0[0, 0]=w224)
        Divide(x=w224, y=70) -> w225
        Multiply(w225, 1000) -> w226
        Feedback Node(input=w227) -> w228
        Build Array(w228, w226) -> w227
        Build Cluster(w222, w227) -> w229
        $VAC <- w229
        w52 = s3
        w53 = default
      }
      frame "Optic Filter Config" {
        Variant To Data(error in (no error)=w50, type=string "", variant=w49) -> (data=w230, error out=w231)
        case (w230) {
          frame "No Filter", Default {
            w232 = ["@SERV 3 90#", "@SERV 4 0#"]
            w233 = "No Filter"
          }
          frame "Filter 1" {
            w232 = ["@SERV 3 90#", "@SERV 4 0#", "@SERV 3 0#"]
            w233 = w230
          }
          frame "Filter 2" {
            w232 = ["@SERV 3 90#", "@SERV 4 0#", "@SERV 4 90#"]
            w233 = w230
          }
        }
        Property Node(instance in=reference to "PV-Optical Filter", "ValueSignaling"=w233)
        Property Node(instance in=s4) -> ("VISA Resource"=w234, instance out=w54)
        call "VISA Multiple Write.gvi"(VISA_IN=w234, ARRAY_IN=w232, ERROR_IN=w231) -> (ERROR_OUT=w51)
        w52 = s3
        w53 = default
      }
      frame "Fans Control" {
        Variant To Data(error in (no error)=w50, type=string "", variant=w49) -> (data=w235, error out=w236)
        case (w235) {
          frame "0", Default {
            w237 = ["@DO 11 0#", "@DO 12 0#"]
            w238 = "0"
          }
          frame "100" {
            w237 = ["@PWM 11 255#", "@PWM 12 255#"]
            w238 = "100"
          }
          frame "50" {
            w237 = ["@PWM 11 127#", "@PWM 12 127#"]
            w238 = "50"
          }
        }
        Property Node(instance in=reference to "PV-Cooling", "ValueSignaling"=w238)
        Property Node(instance in=s4) -> ("VISA Resource"=w239, instance out=w54)
        call "VISA Multiple Write.gvi"(VISA_IN=w239, ARRAY_IN=w237, ERROR_IN=w236) -> (ERROR_OUT=w51)
        w52 = s3
        w53 = default
      }
      frame "Heat Config" {
        Variant To Data(error in (no error)=w50, type=string "", variant=w49) -> (data=w240, error out=w241)
        case (w240) {
          frame "0", Default {
            w242 = ["@DO 9 0#"]
            w243 = "0"
          }
          frame "50" {
            w242 = ["@PWM 9 125#"]
            w243 = "50"
          }
          frame "100" {
            w242 = ["@PWM 9 255#"]
            w243 = "100"
          }
        }
        Property Node(instance in=reference to "PV-Heating", "ValueSignaling"=w243)
        Property Node(instance in=s4) -> ("VISA Resource"=w244, instance out=w54)
        call "VISA Multiple Write.gvi"(VISA_IN=w244, ARRAY_IN=w242, ERROR_IN=w241) -> (ERROR_OUT=w51)
        w52 = s3
        w53 = default
      }
      frame "Set PV Angle" {
        Variant To Data(error in (no error)=w50, type=u32 0, variant=w49) -> (data=w245, error out=w246)
        # Set angle limits for PV panels
        In Range And Coerce(lower limit=0, upper limit=180, x=w245) -> (coerced(x)=w247)
        Property Node(instance in=reference to "PV-Panel Tilt Angle, º", "ValueSignaling"=w247)
        Property Node(instance in=s4) -> ("VISA Resource"=w248, instance out=w54)
        Number To Decimal String(number=w247) -> (decimal integer string=w249)
        Concatenate Strings("@SERV 13 ", w249, "#") -> w250
        call "VISA ReadWrite.gvi"(VISA_IN=w248, CMD=w250, ERROR_IN=w246) -> (ERROR_OUT=w51)
        w52 = s3
        w53 = default
      }
      frame "Brightness Config" {
        Property Node(instance in=s4) -> ("VISA Resource"=w251, instance out=w54)
        Variant To Data(error in (no error)=w50, type=u32 0, variant=w49) -> (data=w252, error out=w253)
        # Set brightness limits
        In Range And Coerce(lower limit=0, upper limit=100, x=w252) -> (coerced(x)=w254)
        Number To Decimal String(number=w254) -> (decimal integer string=w255)
        Concatenate Strings("@DIM 6 ", w255, "#") -> w256
        call "VISA ReadWrite.gvi"(VISA_IN=w251, CMD=w256, ERROR_IN=w253) -> (ERROR_OUT=w51)
        w52 = s3
        w53 = default
      }
      frame "IR Thermometer Position" {
        Variant To Data(error in (no error)=w50, type=string "", variant=w49) -> (data=w257, error out=w258)
        case (w257) {
          frame "None", Default {
            w259 = "@SERV 5 0#"
            w260 = w257
          }
          frame "Panel 1" {
            w259 = "@SERV 5 50#"
            w260 = w257
          }
          frame "Panel 2" {
            w259 = "@SERV 5 75#"
            w260 = w257
          }
          frame "Panel 3" {
            w259 = "@SERV 5 110#"
            w260 = w257
          }
          frame "Panel 4" {
            w259 = "@SERV 5 130#"
            w260 = w257
          }
        }
        Property Node(instance in=reference to "PV-Temperature IR Position", "ValueSignaling"=w260)
        Property Node(instance in=s4) -> ("VISA Resource"=w261, instance out=w54)
        call "VISA ReadWrite.gvi"(VISA_IN=w261, CMD=w259, ERROR_IN=w258) -> (ERROR_OUT=w51)
        w52 = s3
        w53 = default
      }
      frame "Set LoadR" {
        Property Node(instance in=s4) -> ("VISA Resource"=w262, instance out=w54)
        Variant To Data(error in (no error)=w50, type=string "", variant=w49) -> (data=w263, error out=w264)
        # Disconnect ALL load
        w265 = ["@DO 42 1#", "@DO 34 0#", "@DO 35 0#", "@DO 36 0#", "@DO 37 0#", "@DO 38 0#", "@DO 39 0#", "@DO 40 0#", "@DO 41 0#", "@DO 43 0#", "@DO 44 0#", "@DO 45 0#", "@DO 46 0#", "@DO 47 0#", "@DO 48 0#", "@DO 49 0#"]
        sequence {
          frame 0 {
            call "VISA Multiple Write.gvi"(VISA_IN=w262, ARRAY_IN=w265, ERROR_IN=w264) -> (VISA_OUT=w266, ERROR_OUT=w267)
            $"Total Set LoadR" <- 1
          }
        }
        s6 = w263  # shift register
        s7 = 0  # shift register
        s8 = ""  # shift register
        while {
          Match Pattern(regular expression=",", string=s6) -> (after substring=w268, before substring=w269)
          s9 = w269  # shift register
          s10 = s7  # shift register
          while {
            Match Pattern(regular expression=",", string=s9) -> (after substring=w270, before substring=w271)
            case (w271) {
              frame "1" {
                call "VISA ReadWrite.gvi"(VISA_IN=w266, CMD="@DO 43 1#", ERROR_IN=w267) -> (ERROR_OUT=w272)
                w273 = w271
              }
              frame "2" {
                call "VISA ReadWrite.gvi"(VISA_IN=w266, CMD="@DO 44 1#", ERROR_IN=w267) -> (ERROR_OUT=w272)
                w273 = w271
              }
              frame "3" {
                call "VISA ReadWrite.gvi"(VISA_IN=w266, CMD="@DO 45 1#", ERROR_IN=w267) -> (ERROR_OUT=w272)
                w273 = w271
              }
              frame "5" {
                call "VISA ReadWrite.gvi"(VISA_IN=w266, CMD="@DO 46 1#", ERROR_IN=w267) -> (ERROR_OUT=w272)
                w273 = w271
              }
              frame "10" {
                call "VISA ReadWrite.gvi"(VISA_IN=w266, CMD="@DO 47 1#", ERROR_IN=w267) -> (ERROR_OUT=w272)
                w273 = w271
              }
              frame "20" {
                call "VISA ReadWrite.gvi"(VISA_IN=w266, CMD="@DO 48 1#", ERROR_IN=w267) -> (ERROR_OUT=w272)
                w273 = w271
              }
              frame "40" {
                call "VISA ReadWrite.gvi"(VISA_IN=w266, CMD="@DO 49 1#", ERROR_IN=w267) -> (ERROR_OUT=w272)
                w273 = w271
              }
              frame "50" {
                call "VISA ReadWrite.gvi"(VISA_IN=w266, CMD="@DO 34 1#", ERROR_IN=w267) -> (ERROR_OUT=w272)
                w273 = w271
              }
              frame "100" {
                call "VISA ReadWrite.gvi"(VISA_IN=w266, CMD="@DO 35 1#", ERROR_IN=w267) -> (ERROR_OUT=w272)
                w273 = w271
              }
              frame "200" {
                call "VISA ReadWrite.gvi"(VISA_IN=w266, CMD="@DO 36 1#", ERROR_IN=w267) -> (ERROR_OUT=w272)
                w273 = w271
              }
              frame "400" {
                call "VISA ReadWrite.gvi"(VISA_IN=w266, CMD="@DO 37 1#", ERROR_IN=w267) -> (ERROR_OUT=w272)
                w273 = w271
              }
              frame "500" {
                call "VISA ReadWrite.gvi"(VISA_IN=w266, CMD="@DO 38 1#", ERROR_IN=w267) -> (ERROR_OUT=w272)
                w273 = w271
              }
              frame "1000" {
                call "VISA ReadWrite.gvi"(VISA_IN=w266, CMD="@DO 39 1#", ERROR_IN=w267) -> (ERROR_OUT=w272)
                w273 = w271
              }
              frame "2000" {
                call "VISA ReadWrite.gvi"(VISA_IN=w266, CMD="@DO 40 1#", ERROR_IN=w267) -> (ERROR_OUT=w272)
                w273 = w271
              }
              frame "4000" {
                call "VISA ReadWrite.gvi"(VISA_IN=w266, CMD="@DO 41 1#", ERROR_IN=w267) -> (ERROR_OUT=w272)
                w273 = w271
              }
              frame "0", Default {
                # Short Circut
                # Схема сопротивления
                # 1 Ом + 1 Ом токовый резистор
                w272 = w267
                w273 = "Short Circuit (<1 Ohm)"
              }
            }
            Decimal String To Number(string=w273) -> (number=w274)
            Add(w274, s10) -> w275
            $"Total Set LoadR" <- w275
            Concatenate Strings(s8, ",", w273) -> w276
            $"Total LoadR_SET" <- w276
            Is Empty String Or Path(string/path=w270) -> w277
            next s9 = w270
            next s10 = w275
            stop if w277
          }
          Is Empty String Or Path(string/path=w268) -> w278
          next s6 = w268
          next s7 = s10
          next s8 = w276
          stop if w278
        }
        # Connect Load
        call "VISA ReadWrite.gvi"(VISA_IN=w262, CMD="@DO 42 0#", ERROR_IN=w272) -> (ERROR_OUT=w51)
        $"Total Set LoadR" <- s7
        Property Node(instance in=reference to "PV-LoadR,Ohm", "ValueSignaling"=s7)
        $"Total LoadR_SET" <- s8
        Property Node(instance in=reference to "PV-LoadRTotal", "ValueSignaling"=s8)
        w52 = s3
        w53 = default
      }
      frame "NoLoad" {
        # Сопротивление в начальное положение
        Property Node(instance in=reference to "PV-LoadRTotal", "ValueSignaling"="Disconnected (NO LOAD)")
        $"Total LoadR_SET" <- "Disconnected (NO LOAD)"
        Property Node(instance in=reference to "PV-LoadR,Ohm", "ValueSignaling"=-1)
        $"Total Set LoadR" <- -1
        Property Node(instance in=s4) -> ("VISA Resource"=w279, instance out=w54)
        # Размыкаются всё реле, сопротивление- бесконечность
        w280 = ["@DO 42 1#", "@DO 34 1#", "@DO 35 1#", "@DO 36 1#", "@DO 37 1#", "@DO 38 1#", "@DO 39 1#", "@DO 40 1#", "@DO 41 1#", "@DO 43 1#", "@DO 44 1#", "@DO 45 1#", "@DO 46 1#", "@DO 47 1#", "@DO 48 1#", "@DO 49 1#"]
        # Disconnect all Load adn breake circuit
        # NO LOAD
        call "VISA Multiple Write.gvi"(VISA_IN=w279, ARRAY_IN=w280, ERROR_IN=w50) -> (ERROR_OUT=w51)
        w52 = s3
        w53 = default
      }
      frame "Error" {
        Variant To Data(error in (no error)=w50, type=no error, variant=w49) -> (data=w281, error out=w51)
        # #CodeRecommended - If you ever change the name of this "Error" message, you'll need to update the name in the Check Loop Error.vi as well.
        call "Display Error.gvi"(error in=w281)
        w52 = s3
        w53 = default
        w54 = s4
      }
      frame "Exit" {
        Generate User Event(event data=TRUE, user event=w26) -> (error out=w282)
        Release Queue(error in=w50, queue=w47) -> (error out=w283)
        Property Node(instance in=s4) -> ("VISA Resource"=w284, "Physical Channel"=w285)
        call "DAQmx Stop Task.gvi"(task in=w285) -> (error out=w286)
        call "Close (Instr).gvi"(session in=w284, error in=w286) -> (error out=w287)
        Merge Errors(w287, w282, w283) -> (error out=w51)
        w52 = s3
        w53 = TRUE
        w54 = default
      }
      frame Default {
        w288 = "The invalid message string \"%s\" was received in the Message Handling Loop."
        Format Into String(formatString=w288, w48) -> w289
        call "Build Error Cluster.gvi"(code=1, description=w289) -> (error out=w51)
        w52 = s3
        w53 = default
        w54 = s4
      }
    }
    call "Error Handler - Message Handling Loop.gvi"(message queue in=w47, error in=w51) -> (dup error in=w290)
    next s3 = w52
    next s4 = w54
    stop if w53
  }
  $"Server URL" <- "https://api.systemlinkcloud.com/"
  $"Exit 2" <- FALSE
  $SendArrayDoubleToCloud <- "Send Measured Data To Cloud"
  $SendStringToCloud <- "Send String To Cloud"
  $SendDoubleToCloud <- "Send Double To Cloud"
  w291 = bool FALSE  # Stop Event
  Create User Event[EventName="Stop Event"](user event data type=w291) -> (error out=w292, user event out=w293)
  call "Create All Message Queues.gvi"(error in=w292) -> (message queues=w294, error out=w295)
  Property Node(instance in=w294) -> ("UI"=w296)
  s11 = "UI Data.gtype" {all zero or empty}  # shift register
  while {
    call "Dequeue Message.gvi"(message queue in=w296, error in=w295) -> (message queue out=w297, message=w298, message data=w299, error out=w300)
    # s11: Data
    # w293: Stop Event
    case (w298) ignore case {  # Message Cases
      frame "Initialize" {
        Property Node(instance in=s11, "String"=w298) -> (instance out=w302)
        call "Enqueue Message (Single).gvi"(message queue in=w297, message="Update Display", message data=w298, error in=w300) -> (message queue out=w304, error out=w305)
        # Bundle a sample string value.
        call "Enqueue Message (Single).gvi"(message queue in=w304, message=$SendArrayDoubleToCloud, error in=w305) -> (error out=w301)
        Property Node(instance in=reference to "PV-Temperature, ºC", "ValueSignaling"=0)
        Property Node(instance in=reference to "MV-Panel Configuration", "Value"="none")
        Property Node(instance in=reference to "PV-Panel Cofiguration", "ValueSignaling"="none")
        Property Node(instance in=reference to "MV-Heating", "Value"="none")
        Property Node(instance in=reference to "PV-Temperature IR, ºC", "ValueSignaling"=0)
        Property Node(instance in=reference to "PV-Heating", "ValueSignaling"="none")
        Property Node(instance in=reference to "MV-Cooling", "Value"="none")
        Property Node(instance in=reference to "PV-LightIntensity, W/m2", "ValueSignaling"=0)
        Property Node(instance in=reference to "PV-Cooling", "ValueSignaling"="none")
        Property Node(instance in=reference to "MV-Light Power", "Value"="none")
        Property Node(instance in=reference to "PV-Panel Tilt Angle, º", "ValueSignaling"=0)
        Property Node(instance in=reference to "PV-Optical Filter", "ValueSignaling"="none")
        Property Node(instance in=reference to "MV-Optical Filter", "Value"="none")
        Property Node(instance in=reference to "PV-LigthPower, %", "ValueSignaling"=0)
        Property Node(instance in=reference to "PV-LoadR4", "ValueSignaling"="none")
        Property Node(instance in=reference to "MV-Panel Tilt Angle", "Value"="none")
        Property Node(instance in=reference to "PV-Voltage, V", "ValueSignaling"=0)
        Property Node(instance in=reference to "PV-LoadR3", "ValueSignaling"="none")
        Property Node(instance in=reference to "MV-LoadR1", "Value"="none")
        Property Node(instance in=reference to "PV-LoadR2", "ValueSignaling"="none")
        Property Node(instance in=reference to "PV-Current, mA", "ValueSignaling"=0)
        Property Node(instance in=reference to "MV-LoadR2", "Value"="none")
        Property Node(instance in=reference to "PV-LoadR1", "ValueSignaling"="none")
        Property Node(instance in=reference to "PV-LoadR,Ohm", "ValueSignaling"=0)
        Property Node(instance in=reference to "MV-LoadR3", "Value"="none")
        Property Node(instance in=reference to "PV-LoadRTotal", "ValueSignaling"="none")
        Property Node(instance in=reference to "MV-LoadR4", "Value"="none")
        Property Node(instance in=reference to "MV-LoadRTotal", "Value"="none")
        w303 = default
      }
      frame "Something" {
        # #CodeNeeded - Perform whatever actions correspond to the "Something" message.
        # Send string to "Update Display" message
        call "Enqueue Message (Single).gvi"(message queue in=w297, message="Update Display", message data="\"Do Something\" button pressed", error in=w300) -> (error out=w301)
        w302 = s11
        w303 = default
      }
      frame "Something Else" {
        # #CodeNeeded - Perform whatever actions correspond to the "Something Else" message.
        # Send string to "Update Display" message
        call "Enqueue Message (Single).gvi"(message queue in=w297, message="Update Display", message data="\"Do Something Else\" button pressed", error in=w300) -> (error out=w301)
        w302 = s11
        w303 = default
      }
      frame "Update Display" {
        # #CodeRecommended - If you wish to decouple the Message Handling Loop from your user interface, consider creating User Events (like the "Stop" event in this VI) to message the Event Handling Loop whenever the user interface needs updating.
        Variant To Data(error in (no error)=w300, type=string "", variant=w299) -> (data=w306, error out=w301)
        $"Status of Send to SystemLink Cycle" <- w306
        w302 = s11
        w303 = default
      }
      frame "Error" {
        Variant To Data(error in (no error)=w300, type=no error, variant=w299) -> (data=w307, error out=w301)
        # #CodeRecommended - Consider creating a system for logging errors in some way. These errors are for notification purposes only. Handling of specific errors should be performed in the message frames that generated the error.
        # #CodeRecommended - If you ever change the name of this "Error" message, you'll need to update the name in the Check Loop Error.vi as well.
        call "Display Error.gvi"(error in=w307)
        w302 = s11
        w303 = default
      }
      frame "---Copy This Frame---" {
        Merge Errors(w300) -> (error out=w301)
        w302 = s11
        w303 = default
      }
      frame "Exit" {
        # Release the message queue reference
        Release Queue(error in=w300, queue=w297) -> (error out=w308)
        # #CodeNeeded - Add any required cleanup code here. Note that if 'Exit' was called as a result of an error, an error dialog will be displayed. Add any custom error handling for an 'Exit' condition here as well.
        Generate User Event(event data=TRUE, user event=w293) -> (error out=w309)
        Merge Errors(w309, w308) -> (error out=w301)
        # Stop the VI
        $"Exit 2" <- TRUE
        w302 = s11
        w303 = TRUE
      }
      frame Default {
        w310 = "The invalid message string \"%s\" was received in the Message Handling Loop."
        Format Into String(formatString=w310, w298) -> w311
        call "Build Error Cluster.gvi"(code=1, description=w311) -> (error out=w301)
        w302 = s11
        w303 = default
      }
      frame "Send Double To Cloud" {
        Property Node(instance in=s11, "String"=w298) -> (instance out=w302)
        call "Open Configuration API Key.gvi"(server url=$"Server URL", api key=$"API Key", error in=w300) -> (configuration=w312)
        Variant To Data(type=string[] [], variant=w299) -> (data=w313)
        Array Index(array=w313) -> (out0[0]=w314, out1[1]=w315)
        Floating Point String To Number(string=w315) -> (number=w316)
        Build Array(w314) -> w317
        call "Query Tags.gvi"(paths=w317, configuration=w312) -> (tags=w318, error out=w319)
        Array Index(array=w318) -> (out0[_]=w320)
        Property Node(instance in=w320) -> ("Path"=w321, "Datatype"=w322)
        call "Open Tag.gvi"(path=w321, data type=w322, error in=w319, configuration=w312) -> (tag=w323, error out=w324)
        call "Write Tag (DBL).gvi"(tag in=w323, value=w316, error in=w324) -> (tag out=w325, error out=w326)
        call "Close Tag (Single).gvi"(tag=w325, error in=w326) -> (error out=w327)
        call "Close Configuration.gvi"(configuration=w312, error in=w327) -> (error out=w301)
        call "Enqueue Message (Single).gvi"(message queue in=w297, message="Update Display", message data=w298)
        w303 = default
      }
      frame "Send Measured Data To Cloud" {
        Property Node(instance in=s11, "String"=w298) -> (instance out=w302)
        call "Enqueue Message (Single).gvi"(message queue in=w297, message="Update Display", message data=w298, error in=w300) -> (message queue out=w328, error out=w329)
        call "Enqueue Message (Single).gvi"(message queue in=w328, message=$SendArrayDoubleToCloud, error in=w329) -> (error out=w330)
        call "Open Configuration API Key.gvi"(server url=$"Server URL", api key=$"API Key", error in=w330) -> (configuration=w331, error out=w332)
        w333 = ["PV-Current", "PV-Voltage", "PV-LigthtIntensity", "PV-Temperature"]
        call "Query Tags.gvi"(paths=w333, error in=w332, configuration=w331) -> (tags=w334, error out=w335)
        Property Node(instance in=$"Measured Data") -> ("Voltage, V"=w336, "Current, mA"=w337, "Luminous Flux, Lux"=w338, "Temperature, GradC"=w339)
        Build Array(w336, w337, w338, w339) -> w340
        for {
          w341 = each element of w334
          w342 = each element of w340
          Property Node(instance in=w341) -> ("Path"=w343, "Datatype"=w344)
          call "Open Tag.gvi"(path=w343, data type=w344, error in=w335, configuration=w331) -> (tag=w345, error out=w346)
          call "Write Tag (DBL).gvi"(tag in=w345, value=w342, error in=w346) -> (error out=w347)
        }
        for {
          w348 = each element of w334
          call "Close Tag (Single).gvi"(tag=w348, error in=w347) -> (error out=w349)
        }
        call "Close Configuration.gvi"(configuration=w331, error in=w349) -> (error out=w301)
        w303 = default
      }
      frame "Send String To Cloud" {
        Property Node(instance in=s11, "String"=w298) -> (instance out=w302)
        call "Open Configuration API Key.gvi"(server url=$"Server URL", api key=$"API Key", error in=w300) -> (configuration=w350, error out=w351)
        Variant To Data(type=string[] [], variant=w299) -> (data=w352)
        Array Index(array=w352) -> (out0[0]=w353, out1[1]=w354)
        Build Array(w353) -> w355
        call "Query Tags.gvi"(paths=w355, configuration=w350) -> (tags=w356)
        Array Index(array=w356) -> (out0[_]=w357)
        Property Node(instance in=w357) -> ("Path"=w358, "Datatype"=w359)
        call "Open Tag.gvi"(path=w358, data type=w359, error in=w351, configuration=w350) -> (tag=w360, error out=w361)
        call "Write Tag (String).gvi"(tag in=w360, value=w354, error in=w361) -> (tag out=w362, error out=w363)
        call "Close Tag (Single).gvi"(tag=w362, error in=w363) -> (error out=w364)
        call "Close Configuration.gvi"(configuration=w350, error in=w364) -> (error out=w301)
        call "Enqueue Message (Single).gvi"(message queue in=w297, message="Update Display", message data=w298)
        w303 = default
      }
    }
    call "Error Handler - Message Handling Loop.gvi"(message queue in=w297, error in=w301) -> (dup error in=w365)
    next s11 = w302
    stop if w303
  }
  Register For Events("Stop Event"=w293) -> (event registration refnum out=w366)
  s12 = w366  # shift register
  while {
    event (dynamic events = s12) {
      on "Do Something" Value changed {
        # #CodeNeeded - Send the appropriate message for this user interface event.
        call "Enqueue Message (Single).gvi"(message queue in=w296, message="Something") -> (message queue out=w369, error out=w368)
        w367 = default
      }
      on "Do Something Else" Value changed {
        # #CodeNeeded - Send the appropriate message for this user interface event.
        call "Enqueue Message (Single).gvi"(message queue in=w296, message="Something Else") -> (message queue out=w369, error out=w368)
        w367 = default
      }
      on "Exit" Value changed {
        call "Enqueue Message (Single).gvi"(priority message=TRUE, message queue in=w296, message="Exit") -> (message queue out=w369, error out=w368)
        w367 = default
      }
      on dynamic event 0 {
        # The Message Handling Loop processed an "Exit" message, which fired this event to stop the Event Handling Loop.
        $"Status of Send to SystemLink Cycle" <- "\"Exit\" button pressed"
        w367 = TRUE
        w368 = default
        w369 = w296
      }
      on "Window" Close? {
        call "Enqueue Message (Single).gvi"(priority message=TRUE, message queue in=w296, message="Exit") -> (message queue out=w369)
        Event Filter("Discard?"=TRUE)
        w367 = default
        w368 = default
      }
      on "PV-Current, mA" Value changed {
        Event Data() -> ("New Value"=w370)
        Number To Fractional String(number=w370) -> (F-format string=w371)
        Build Array("PV-Current", w371) -> w372
        call "Enqueue Message (Single).gvi"(message queue in=w296, message=$SendDoubleToCloud, message data=w372) -> (message queue out=w369, error out=w368)
        w367 = default
      }
      on "PV-LoadR,Ohm" Value changed {
        Event Data() -> ("New Value"=w373)
        Number To Fractional String(number=w373) -> (F-format string=w374)
        Build Array("PV-LoadR", w374) -> w375
        call "Enqueue Message (Single).gvi"(message queue in=w296, message=$SendDoubleToCloud, message data=w375) -> (message queue out=w369, error out=w368)
        w367 = default
      }
      on "PV-Voltage, V" Value changed {
        Event Data() -> ("New Value"=w376)
        Number To Fractional String(number=w376) -> (F-format string=w377)
        Build Array("PV-Voltage", w377) -> w378
        call "Enqueue Message (Single).gvi"(message queue in=w296, message=$SendDoubleToCloud, message data=w378) -> (message queue out=w369, error out=w368)
        w367 = default
      }
      on "PV-Temperature, ºC" Value changed {
        Event Data() -> ("New Value"=w379)
        Number To Fractional String(number=w379) -> (F-format string=w380)
        Build Array("PV-Temperature", w380) -> w381
        call "Enqueue Message (Single).gvi"(message queue in=w296, message=$SendDoubleToCloud, message data=w381) -> (message queue out=w369, error out=w368)
        w367 = default
      }
      on "PV-Temperature IR, ºC" Value changed {
        Event Data() -> ("New Value"=w382)
        Number To Fractional String(number=w382) -> (F-format string=w383)
        Build Array("PV-Temperature IR", w383) -> w384
        call "Enqueue Message (Single).gvi"(message queue in=w296, message=$SendDoubleToCloud, message data=w384) -> (message queue out=w369, error out=w368)
        w367 = default
      }
      on "PV-LightIntensity, W/m2" Value changed {
        Event Data() -> ("New Value"=w385)
        Number To Fractional String(number=w385) -> (F-format string=w386)
        Build Array("PV-LigthtIntensity", w386) -> w387
        call "Enqueue Message (Single).gvi"(message queue in=w296, message=$SendDoubleToCloud, message data=w387) -> (message queue out=w369, error out=w368)
        w367 = default
      }
      on "PV-LigthPower, %" Value changed {
        Event Data() -> ("New Value"=w388)
        Number To Fractional String(number=w388) -> (F-format string=w389)
        Build Array("PV-LigthtPower", w389) -> w390
        call "Enqueue Message (Single).gvi"(message queue in=w296, message=$SendDoubleToCloud, message data=w390) -> (message queue out=w369, error out=w368)
        w367 = default
      }
      on "PV-Panel Tilt Angle, º" Value changed {
        Event Data() -> ("New Value"=w391)
        Number To Fractional String(number=w391) -> (F-format string=w392)
        Build Array("PV-Panel Tilt Angle", w392) -> w393
        call "Enqueue Message (Single).gvi"(message queue in=w296, message=$SendDoubleToCloud, message data=w393) -> (message queue out=w369, error out=w368)
        w367 = default
      }
      on "PV-Panel Cofiguration" Value changed {
        Event Data() -> ("New Value"=w394)
        Build Array("PV-Panel Configuration", w394) -> w395
        call "Enqueue Message (Single).gvi"(message queue in=w296, message=$SendStringToCloud, message data=w395) -> (message queue out=w369, error out=w368)
        w367 = default
      }
      on "PV-Temperature IR Position" Value changed {
        Event Data() -> ("New Value"=w396)
        Build Array("PV-Temperature IR Position", w396) -> w397
        call "Enqueue Message (Single).gvi"(message queue in=w296, message=$SendStringToCloud, message data=w397) -> (message queue out=w369, error out=w368)
        w367 = default
      }
      on "PV-Cooling" Value changed {
        Event Data() -> ("New Value"=w398)
        Build Array("PV-Cooling", w398) -> w399
        call "Enqueue Message (Single).gvi"(message queue in=w296, message=$SendStringToCloud, message data=w399) -> (message queue out=w369, error out=w368)
        w367 = default
      }
      on "PV-Heating" Value changed {
        Event Data() -> ("New Value"=w400)
        Build Array("PV-Heating", w400) -> w401
        call "Enqueue Message (Single).gvi"(message queue in=w296, message=$SendStringToCloud, message data=w401) -> (message queue out=w369, error out=w368)
        w367 = default
      }
      on "PV-Optical Filter" Value changed {
        Event Data() -> ("New Value"=w402)
        Build Array("PV-Optical Filter", w402) -> w403
        call "Enqueue Message (Single).gvi"(message queue in=w296, message=$SendStringToCloud, message data=w403) -> (message queue out=w369, error out=w368)
        w367 = default
      }
      on "PV-LoadR1" Value changed {
        Event Data() -> ("New Value"=w404)
        Build Array("PV-LoadR1", w404) -> w405
        call "Enqueue Message (Single).gvi"(message queue in=w296, message=$SendStringToCloud, message data=w405) -> (message queue out=w369)
        w367 = default
        w368 = default
      }
      on "PV-LoadR2" Value changed {
        Event Data() -> ("New Value"=w406)
        Build Array("PV-LoadR2", w406) -> w407
        call "Enqueue Message (Single).gvi"(message queue in=w296, message=$SendStringToCloud, message data=w407) -> (message queue out=w369)
        w367 = default
        w368 = default
      }
      on "PV-LoadR3" Value changed {
        Event Data() -> ("New Value"=w408)
        Build Array("PV-LoadR3", w408) -> w409
        call "Enqueue Message (Single).gvi"(message queue in=w296, message=$SendStringToCloud, message data=w409) -> (message queue out=w369)
        w367 = default
        w368 = default
      }
      on "PV-LoadR4" Value changed {
        Event Data() -> ("New Value"=w410)
        Build Array("PV-LoadR4", w410) -> w411
        call "Enqueue Message (Single).gvi"(message queue in=w296, message=$SendStringToCloud, message data=w411) -> (message queue out=w369)
        w367 = default
        w368 = default
      }
      on "PV-LoadRTotal" Value changed {
        Event Data() -> ("New Value"=w412)
        Build Array("PV-LoadRTotal", w412) -> w413
        call "Enqueue Message (Single).gvi"(message queue in=w296, message=$SendStringToCloud, message data=w413) -> (message queue out=w369)
        w367 = default
        w368 = default
      }
    }
    call "Error Handler - Event Handling Loop.gvi"(message queue in=w369, error in=w368) -> (dup error in=w414)
    stop if w367
  }
  Unregister For Events(error in=w414, event registration refnum=s12) -> (error out=w415)
  Merge Errors(w415, w365) -> (error out=w416)
  Destroy User Event(error in=w416, user event=w293)
  disable {
    frame Enabled { }
    frame Disabled {
      call "Initialize.gvi"(device name="cam0") -> (session out=w417, error out=w418)
      call "Configure Grab.gvi"(session in=w417, error in=w418) -> (session out=w419, error out=w420)
      call "Create Image.gvi"(image name="image_1") -> (new image=w421)
      while {
        call "Grab.gvi"(session in=w419, error in=w420, image in=w421) -> (session out=w422, error out=w423)
        stop if $Stop
      }
      call "Close.gvi"(session=w422, error in=w423)
    }
  }
