vi "Main.gvi"   [LabVIEW NXG 5.0.0]
# This template is for the Queued Message Handler design pattern.
# The Event Handling Loop generates messages based on user interface actions.
# The Message Handling Loop processes messages generated by the Event Handling Loop, or by other messages.  The messages are string values, so new messages can be added easily to the Message Cases case structure in the Message Handling Loop.  Each message cluster can also provide an optional value for Message Data, which is a variant that can be converted to whatever message-specific data is required.
panel controls:
  "Exit": bool
  "TEMP Button": bool
  "LUX Button": bool
  "VISA Resource Name": "VISA Instr" = "COM5"
  "Initialize VISA": bool
  "CMD Button": bool
  "Initialize AI": bool
  "PV Config Button": bool
  "Set PV Angle Button": bool
  "IR Thermometer Config Button": bool
  "Fans Button": bool
  "Brightness Config Button": bool
  "Optic Filter Config Button": bool
  "Reset CVM Button": bool
  "Stop": bool
  "PV Config Selector": string
  "PV Angle": i32
  "Fans Selector": string
  "Optic Filter Selector": string
  "IR Thermometer Selector": string
  "Brightness": i32
  "Prepare CVM": bool
  "Command to Arduino": string = "@DO 34 0#"
  "Set LoadR": bool
  "Reset LoadR": bool
  "Total LoadR: R Values separated by coma": string
  "VAC Button": bool
  "Heat Selector": string
  "Heat Button": bool
  "Exit 2": bool
  "Do Something": bool
  "Do Something Else": bool
  "PV-Current, mA": f64
  "PV-LoadR,Ohm": f64
  "PV-Voltage, V": f64
  "PV-Temperature, ºC": f64
  "PV-LightIntensity, W/m2": f64
  "PV-Panel Tilt Angle, º": f64
  "PV-Panel Cofiguration": string
  "PV-Cooling": string
  "PV-Heating": string
  "PV-Optical Filter": string
  "PV-LoadR1": string
  "PV-LoadR2": string
  "PV-LoadR3": string
  "PV-LoadR4": string
  "Tab": i32
  "MeasuredData": f64[]
  "LoadR1": string
  "LoadR10": string
  "LoadR100": string
  "LoadR1000": string
panel indicators:
  "Display": string
  "Command reply": "ArduinoReply.gtype"
  "Reply LUX": "ArduinoReply.gtype"
  "Reply TEMP": "ArduinoReply.gtype"
  "AI measurements": waveform<f64>[]
  "Hardware Current Status": string
  "Voltage coeff": f64
  "Current coeff": f64
  "Recalculated Voltage": f64
  "Recalculated Current": f64
  "VAC Load Counter": i32
  "Voltage_Graph": f64[]
  "Output": error
  "VISA Answer_2": "ArduinoReply.gtype"[]
  "Current_Graph": f64[]
  "VAC": cluster{"Element 1": f64[], "Element 2": f64[]}
  "PV-Connecting Solar Panels": string
  "CMD TIME": "ArduinoReply.gtype"
  "MV-Panel Configuration": string
  "MV-Cooling": string
  "MV-Heating": string
  "MV-Optical Filter": string
  "MV-Panel Tilt Angle": string
  "MV-Light Power": string
  "MV-LoadR1": string
  "MV-LoadR2": string
  "MV-LoadR3": string
  "MV-LoadR4": string
  "API Key": string
  "Server URL": string
  "Status of Send to SystemLink Cycle": string
  "SendDoubleToCloud": string
  "SendStringToCloud": string
  "Error out Systemlink Read Cycle": error
  "Voltage MidPoint": f64
  "Current MidPoint": f64
  "Arduino Status": string
  "SendArrayDoubleToCloud": string
  "TempSensor": f64
  "LuxSensor": f64
  "TempSensor Reply": string
  "LuxSensor Reply": string
  "Total Set LoadR": i32
types:
  "ArduinoReply.gtype" = cluster{"Timestamp": timestamp, "DATA": string}
  T1 = cluster{"VISA Resource": "VISA Instr", "Physical Channel": "DAQmx Task"}
  "UI Data.gtype" = cluster{"Boolean": bool, "String": string, "Numeric": f64}
  "ValueRange.gtype" = cluster{"maximum value": f64, "minimum value": f64}
uses:
  NI::Skyline::Configuration::Open Configuration API Key.gvi
  NI::Skyline::TagHTTP::Query Tags.gvi
  NI::Skyline::TagHTTP::Open Tag.gvi
  NI::Skyline::TagHTTP::Read Tag (String).gvi
  NI::Skyline::TagHTTP::Close Tag (Single).gvi
  NI::Skyline::Configuration::Close Configuration.gvi
  Message Queue::Create All Message Queues.gvi
  Message Queue::Enqueue Message (Single).gvi
  Support::Error Handler - Event Handling Loop.gvi
  Message Queue::Dequeue Message.gvi
  NI::VISA::Configure Serial Port (Instr).gvi
  NI::VISA::Open (Instr).gvi
  NI::DAQmx::Internal::DAQmx Create Channel (AI-Voltage-Basic).gvi
  Queued Message Handler::Read_Write_VISA.gvi
  NI::DAQmx::Internal::DAQmx Read (Analog 2D DBL NChan NSamp).gvi
  NI::DAQmx::Internal::DAQmx Read (Analog 1D Wfm NChan NSamp).gvi
  NI::G Core::Strings::Search and Replace Regular Expression.gvi
  NI::G Core::Strings::Search and Replace Pattern.gvi
  Queued Message Handler::PV_switch.gvi
  Queued Message Handler::CMD_Iteration.gvi
  NI::G Core::Error::Display Error.gvi
  NI::DAQmx::Internal::DAQmx Stop Task.gvi
  NI::VISA::Close (Instr).gvi
  NI::G Core::Error::Build Error Cluster.gvi
  Support::Error Handler - Message Handling Loop.gvi
  NI::Skyline::TagHTTP::Write Tag (DBL).gvi
  NI::Skyline::TagHTTP::Write Tag (String).gvi
  NI::Vision::IMAQdx::Initialize.gvi
  NI::Vision::IMAQdx::Configure Grab.gvi
  NI::Vision::Core::Basics::Create Image.gvi
  NI::Vision::IMAQdx::Grab.gvi
  NI::Vision::IMAQdx::Close.gvi
diagram:
  $"MV-Panel Configuration" <- ""
  $"MV-Cooling" <- ""
  $"MV-Heating" <- ""
  $"MV-Optical Filter" <- ""
  $"MV-Panel Tilt Angle" <- ""
  $"MV-Light Power" <- ""
  $"MV-LoadR1" <- ""
  $"MV-LoadR2" <- ""
  $"MV-LoadR3" <- ""
  $"MV-LoadR4" <- ""
  Array Size(array=["MV-Panels Configuration"]) -> (size(s)=w1)
  Initialize Array(element=1904-12-31T23:00:00Z, size=w1) -> w2
  sequence {
    frame 0 {
      Wait(time to wait=20000)
    }
  }
  s1 = w2  # shift register
  while {
    Wait(time to wait=500)
    call "Open Configuration API Key.gvi"(server url=$"Server URL", api key=$"API Key") -> (configuration=w3, error out=w4)
    call "Query Tags.gvi"(paths=["MV-Panels Configuration"], error in=w4, configuration=w3) -> (tags=w5, error out=w6)
    Build Array(reference to "MV-Panel Configuration", reference to "MV-Cooling", reference to "MV-Heating", reference to "MV-Optical Filter", reference to "MV-Panel Tilt Angle", reference to "MV-Light Power", reference to "MV-LoadR1", reference to "MV-LoadR2", reference to "MV-LoadR3", reference to "MV-LoadR4") -> w7
    for {
      w8 = each element of w5
      w9 = each element of s1
      w10 = each element of w7
      Property Node(instance in=w8) -> ("Path"=w12, "Datatype"=w13)
      call "Open Tag.gvi"(path=w12, data type=w13, error in=w6, configuration=w3) -> (tag=w14, error out=w15)
      call "Read Tag (String).gvi"(tag in=w14, error in=w15) -> (value=w16, time stamp=w17, error out=w18)
      Is Greater(x=w17, y=w9) -> w19
      case (w19) {
        frame False, Default { }
        frame True {
          Property Node(instance in=w10, "ValueSignaling"=w16)
        }
      }
      append w17 to w11
    }
    for {
      w20 = each element of w5
      call "Close Tag (Single).gvi"(tag=w20, error in=w18) -> (error out=w21)
    }
    call "Close Configuration.gvi"(configuration=w3, error in=w21) -> (error out=w22)
    $"Error out Systemlink Read Cycle" <- w22
    next s1 = w11
    stop if $"Exit 2"
  }
  $"PV-Connecting Solar Panels" <- ""
  # PV Config
  # 	Single
  # 	Parallel 2
  # 	Parallel 2 Diode
  # 	Series 2
  # 	Series 2 Diode
  # 	Parallel 4
  # 	Parallel 4 Diode
  # 	Series 4
  # 	Series 4 Diode
  # 	Parallel Of Series
  # 	Parallel Of Series Diode
  # 	Series Of Parallel
  # 	Series Of Parallel Diode
  # Optic Filter Config
  # 	No Filter
  # 	Filter 1
  # 	Filter 2
  # IR Thermomether
  # 	None
  # 	Panel 1
  # 	Panel 2
  # 	Panel 3
  # 	Panel 4
  disable {
    frame Enabled { }
    frame Disabled {
      Destroy User Event()
    }
  }
  w23 = bool FALSE  # Stop Event
  Create User Event[EventName="Stop Event"](user event data type=w23) -> (error out=w24, user event out=w25)
  Register For Events("Stop Event"=w25) -> (event registration refnum out=w26)
  call "Create All Message Queues.gvi"(error in=w24) -> (message queues=w27, error out=w28)
  Property Node(instance in=w27) -> ("UI"=w29)
  # Set Load via MV- x4?
  s2 = w26  # shift register
  while {
    event (dynamic events = s2) {
      on "Exit" Value changed {
        call "Enqueue Message (Single).gvi"(priority message=TRUE, message queue in=w29, message="Exit") -> (message queue out=w32, error out=w31)
        w30 = default
      }
      on dynamic event 0 {
        $Display <- "\"Exit\" button pressed"
        w30 = TRUE
        w31 = default
        w32 = w29
      }
      on "Window" Close? {
        call "Enqueue Message (Single).gvi"(priority message=TRUE, message queue in=w29, message="Exit") -> (message queue out=w32)
        Event Filter("Discard?"=TRUE)
        w30 = default
        w31 = default
      }
      on "Initialize VISA" Value changed {
        call "Enqueue Message (Single).gvi"(message queue in=w29, message="Initialize VISA") -> (message queue out=w32, error out=w31)
        w30 = default
      }
      on "Initialize AI" Value changed {
        call "Enqueue Message (Single).gvi"(message queue in=w29, message="Initialize AI") -> (message queue out=w32, error out=w31)
        w30 = default
      }
      on "CMD Button" Value changed {
        call "Enqueue Message (Single).gvi"(message queue in=w29, message="Send CMD") -> (message queue out=w32, error out=w31)
        w30 = default
      }
      on "TEMP Button" Value changed {
        call "Enqueue Message (Single).gvi"(message queue in=w29, message="Get Temperature") -> (message queue out=w32, error out=w31)
        w30 = default
      }
      on "LUX Button" Value changed {
        call "Enqueue Message (Single).gvi"(message queue in=w29, message="Get Brightness") -> (message queue out=w32, error out=w31)
        w30 = default
      }
      on "Reset CVM Button" Value changed {
        call "Enqueue Message (Single).gvi"(message queue in=w29, message="Reset CVM") -> (message queue out=w32, error out=w31)
        w30 = default
      }
      on "PV Config Button" Value changed {
        call "Enqueue Message (Single).gvi"(message queue in=w29, message="PV Config", message data=$"PV Config Selector") -> (message queue out=w32, error out=w31)
        w30 = default
      }
      on "MV-Panel Configuration" Value changed {
        Event Data() -> ("New Value"=w33)
        call "Enqueue Message (Single).gvi"(message queue in=w29, message="PV Config", message data=w33) -> (message queue out=w32, error out=w31)
        w30 = default
      }
      on "Heat Button" Value changed {
        call "Enqueue Message (Single).gvi"(message queue in=w29, message="Heat Config", message data=$"Heat Selector") -> (message queue out=w32, error out=w31)
        w30 = default
      }
      on "PV-Heating" Value changed {
        Event Data() -> ("New Value"=w34)
        call "Enqueue Message (Single).gvi"(message queue in=w29, message="Heat Config", message data=w34) -> (message queue out=w32, error out=w31)
        w30 = default
      }
      on "Set PV Angle Button" Value changed {
        call "Enqueue Message (Single).gvi"(message queue in=w29, message="Set PV Angle", message data=$"PV Angle") -> (message queue out=w32, error out=w31)
        w30 = default
      }
      on "MV-Panel Tilt Angle" Value changed {
        Event Data() -> ("New Value"=w35)
        Decimal String To Number(string=w35) -> (offset past number=w36)
        call "Enqueue Message (Single).gvi"(message queue in=w29, message="Set PV Angle", message data=w36) -> (message queue out=w32, error out=w31)
        w30 = default
      }
      on "IR Thermometer Config Button" Value changed {
        call "Enqueue Message (Single).gvi"(message queue in=w29, message="IR Thermometer", message data=$"IR Thermometer Selector") -> (message queue out=w32, error out=w31)
        w30 = default
      }
      on "Fans Button" Value changed {
        call "Enqueue Message (Single).gvi"(message queue in=w29, message="Fans Control", message data=$"Fans Selector") -> (message queue out=w32, error out=w31)
        w30 = default
      }
      on "MV-Cooling" Value changed {
        Event Data() -> ("New Value"=w37)
        call "Enqueue Message (Single).gvi"(message queue in=w29, message="Fans Control", message data=w37) -> (message queue out=w32, error out=w31)
        w30 = default
      }
      on "Brightness Config Button" Value changed {
        call "Enqueue Message (Single).gvi"(message queue in=w29, message="Brightness Config", message data=$Brightness) -> (message queue out=w32, error out=w31)
        w30 = default
      }
      on "MV-Light Power" Value changed {
        Event Data() -> ("New Value"=w38)
        call "Enqueue Message (Single).gvi"(message queue in=w29, message="Brightness Config", message data=w38) -> (message queue out=w32, error out=w31)
        w30 = default
      }
      on "Optic Filter Config Button" Value changed {
        call "Enqueue Message (Single).gvi"(message queue in=w29, message="Optic Filter Config", message data=$"Optic Filter Selector") -> (message queue out=w32, error out=w31)
        w30 = default
      }
      on "MV-Optical Filter" Value changed {
        Event Data() -> ("New Value"=w39)
        call "Enqueue Message (Single).gvi"(message queue in=w29, message="Optic Filter Config", message data=w39) -> (message queue out=w32, error out=w31)
        w30 = default
      }
      on "Prepare CVM" Value changed {
        call "Enqueue Message (Single).gvi"(message queue in=w29, message="Prepare CVM") -> (message queue out=w32, error out=w31)
        w30 = default
      }
      on "Set LoadR" Value changed {
        $"Total Set LoadR" <- 0
        Concatenate Strings($LoadR1, $LoadR10, $LoadR100, $LoadR1000) -> w40
        call "Enqueue Message (Single).gvi"(message queue in=w29, message="Set LoadR", message data=w40) -> (message queue out=w32, error out=w31)
        w30 = default
      }
      on "Reset LoadR" Value changed {
        call "Enqueue Message (Single).gvi"(message queue in=w29, message="Reset LoadR") -> (message queue out=w32, error out=w31)
        w30 = default
      }
      on "VAC Button" Value changed {
        Property Node(instance in=reference to "VAC")
        Get Current Time() -> (current time=w41)
        call "Enqueue Message (Single).gvi"(message queue in=w29, message="VAC", message data=w41) -> (message queue out=w32)
        $"VAC Load Counter" <- 0
        w30 = default
        w31 = default
      }
    }
    call "Error Handler - Event Handling Loop.gvi"(message queue in=w32, error in=w31) -> (dup error in=w42)
    stop if w30
  }
  Unregister For Events(error in=w42, event registration refnum=s2)
  $"API Key" <- "zYUbuW0YNkg1G__lXfJiGVBNWME-HlVd2a5NUHp-IP"
  s3 = "UI Data.gtype" {all zero or empty}  # shift register
  s4 = T1 {"VISA Resource"="COM5", "Physical Channel"=""}  # shift register
  while {
    call "Dequeue Message.gvi"(message queue in=w29, error in=w28) -> (message queue out=w43, message=w44, message data=w45, error out=w46)
    $"Hardware Current Status" <- w44
    # s3: Data
    # w25: Stop Event
    case (w44) ignore case {  # Message Cases
      frame "Initialize" {
        call "Enqueue Message (Single).gvi"(message queue in=w43, message="Initialize VISA", error in=w46) -> (message queue out=w51, error out=w52)
        call "Enqueue Message (Single).gvi"(message queue in=w51, message="Initialize AI", error in=w52) -> (message queue out=w53, error out=w54)
        call "Enqueue Message (Single).gvi"(message queue in=w53, message="Set Time", error in=w54) -> (message queue out=w55, error out=w56)
        call "Enqueue Message (Single).gvi"(message queue in=w55, message="Reset CVM", error in=w56) -> (message queue out=w57, error out=w58)
        # set time
        #
        # NO initialase SLC
        call "Enqueue Message (Single).gvi"(message queue in=w57, message="Fans Control", message data="0", error in=w58) -> (message queue out=w59, error out=w60)
        call "Enqueue Message (Single).gvi"(message queue in=w59, message="Heat Config", message data="No Heat", error in=w60) -> (message queue out=w61, error out=w62)
        call "Enqueue Message (Single).gvi"(message queue in=w61, message="Optic Filter Config", message data="No Filter", error in=w62) -> (message queue out=w63, error out=w64)
        call "Enqueue Message (Single).gvi"(message queue in=w63, message="IR Thermometer", message data="None", error in=w64) -> (message queue out=w65, error out=w66)
        call "Enqueue Message (Single).gvi"(message queue in=w65, message="Set PV Angle", message data=90, error in=w66) -> (message queue out=w67, error out=w68)
        call "Enqueue Message (Single).gvi"(message queue in=w67, message="PV Config", message data="Parallel 4", error in=w68) -> (message queue out=w69, error out=w70)
        call "Enqueue Message (Single).gvi"(message queue in=w69, message="Wait For Event", error in=w70) -> (error out=w47)
        w48 = s3
        w49 = default
        w50 = s4
      }
      frame "Initialize VISA" {
        call "Configure Serial Port (Instr).gvi"(stop bits="1.0"(10), session in=$"VISA Resource Name", baud rate=115200, parity="None"(0), termination char=0xA, enable termination char=TRUE) -> (session out=w71, error out=w72)
        call "Open (Instr).gvi"(resource name=w71, error in=w72) -> (session out=w73, error out=w74)
        Property Node(instance in=s4, "VISA Resource"=w73) -> (instance out=w50)
        Wait(time to wait=2000)
        Merge Errors(w74, w46) -> (error out=w47)
        w48 = s3
        w49 = default
      }
      frame "Initialize AI" {
        call "DAQmx Create Channel (AI-Voltage-Basic).gvi"(error in=w46, physical channels="Dev1/ai0:1,Dev1/ai3,Dev1/ai7", units="Volts"(10348), measurement range="ValueRange.gtype" {"maximum value"=10, "minimum value"=0}, input terminal configuration="RSE"(10083)) -> (task out=w75, error out=w47)
        Property Node(instance in=s4, "Physical Channel"=w75) -> (instance out=w50)
        w48 = s3
        w49 = default
      }
      frame "Wait For Event" {
        call "Enqueue Message (Single).gvi"(message queue in=w43, message="Watchdog", error in=w46) -> (error out=w47)
        w48 = s3
        w49 = default
        w50 = s4
      }
      frame "Send CMD" {
        Property Node(instance in=s4) -> ("VISA Resource"=w76, instance out=w50)
        call "Enqueue Message (Single).gvi"(message queue in=w43, message="Wait For Event", error in=w46) -> (error out=w77)
        call "Read_Write_VISA.gvi"(VISA_IN=w76, CMD=$"Command to Arduino", ERROR_IN=w77) -> (Arduino_Reply=w78, ERROR_OUT=w47)
        $"Command reply" <- w78
        w48 = s3
        w49 = default
      }
      frame "Set Time" {
        Property Node(instance in=s4) -> ("VISA Resource"=w79, instance out=w50)
        call "Read_Write_VISA.gvi"(VISA_IN=w79, CMD="@TIME 10 CEPHEI#", ERROR_IN=w46) -> (Arduino_Reply=w80, ERROR_OUT=w47)
        $"CMD TIME" <- w80
        w48 = s3
        w49 = default
      }
      frame "Watchdog" {
        Property Node(instance in=s4) -> ("Physical Channel"=w81, "VISA Resource"=w82, instance out=w50)
        call "Read_Write_VISA.gvi"(VISA_IN=w82, CMD="@TIME 10 ?#", ERROR_IN=w46) -> (OUTPUT=w83, Arduino_Reply=w84, ERROR_OUT=w85)
        Property Node(instance in=w84) -> ("DATA"=w86)
        Match Pattern(regular expression="CEPHEI", string=w86) -> (match substring=w87)
        Is Equal(x=w87, y="CEPHEI") -> w88
        case (w88) {
          frame False, Default {
            call "Enqueue Message (Single).gvi"(message queue in=w43, message="Initialize", error in=w85) -> (error out=w47)
          }
          frame True {
            call "Read_Write_VISA.gvi"(VISA_IN=w83, CMD="@LUX 10 1#", ERROR_IN=w85) -> (OUTPUT=w89, Arduino_Reply=w90, ERROR_OUT=w91)
            call "Read_Write_VISA.gvi"(VISA_IN=w89, CMD="@TEMP 8 0#", ERROR_IN=w91) -> (Arduino_Reply=w92, ERROR_OUT=w93)
            call "DAQmx Read (Analog 2D DBL NChan NSamp).gvi"(task in=w81, error in=w93, number of samples per channel=1) -> (error out=w94, data=w95)
            Array Index(array=w95) -> (out0[1, 0]=w96, out1[2, 0]=w97)
            Multiply(w96, 4) -> w98
            Multiply(w98, $"Voltage coeff") -> w99
            Feedback Node(input=w100) -> w101
            Build Array(w101, w99) -> w100
            $Voltage_Graph <- w100
            $"Recalculated Voltage" <- w99
            $"Voltage MidPoint" <- w97
            Array Index(array=w95) -> (out0[0, 0]=w102, out1[3, 0]=w103)
            Divide(x=w102, y=70) -> w104
            Multiply(w104, 1000) -> w105
            Multiply(w105, $"Current coeff") -> w106
            Feedback Node(input=w107) -> w108
            Build Array(w108, w106) -> w107
            $Current_Graph <- w107
            $"Recalculated Current" <- w106
            $"Current MidPoint" <- w103
            call "DAQmx Read (Analog 1D Wfm NChan NSamp).gvi"(task in=w81, error in=w94, number of samples per channel=1) -> (error out=w109, data=w110)
            call "Enqueue Message (Single).gvi"(message queue in=w43, message="Wait For Event", error in=w109) -> (error out=w47)
            Property Node(instance in=reference to "PV-Current, mA", "ValueSignaling"=w106)
            Property Node(instance in=reference to "PV-Voltage, V", "ValueSignaling"=w99)
            $"AI measurements" <- w110
            Property Node(instance in=w92) -> ("DATA"=w111, instance out=w112)
            $"Reply TEMP" <- w112
            $"TempSensor Reply" <- w111
            Property Node(instance in=w90) -> ("DATA"=w113, instance out=w114)
            $"Reply LUX" <- w114
            call "Search and Replace Regular Expression.gvi"(string=w111, search expression="@ER", replace expression="-999") -> (result string=w115)
            call "Search and Replace Pattern.gvi"(string=w115, pattern="@OK REPLY") -> (result string=w116)
            Floating Point String To Number(string=w116, use system decimal point (T)=FALSE) -> (number=w117)
            $TempSensor <- w117
            $"LuxSensor Reply" <- w113
            call "Search and Replace Regular Expression.gvi"(string=w113, search expression="@ER", replace expression="-999") -> (result string=w118)
            call "Search and Replace Pattern.gvi"(string=w118, pattern="@OK REPLY") -> (result string=w119)
            Floating Point String To Number(string=w119) -> (number=w120)
            $LuxSensor <- w120
            Property Node(instance in=reference to "PV-Temperature, ºC", "ValueSignaling"=w117)
            Build Array(w99, w106, w117, w120) -> w121
            $MeasuredData <- w121
            Property Node(instance in=reference to "PV-LightIntensity, W/m2", "ValueSignaling"=w120)
          }
        }
        $"Arduino Status" <- w86
        w48 = s3
        w49 = default
      }
      frame "PV Config" {
        Property Node(instance in=s4) -> ("VISA Resource"=w122, instance out=w50)
        Variant To Data(error in (no error)=w46, type=string "", variant=w45) -> (data=w123, error out=w124)
        call "PV_switch.gvi"(VISA_IN=w122, CTRL="Disconnect", ERROR_IN=w124) -> (VISA_OUT=w125, ERROR_OUT=w126)
        case (w123) {
          frame "Single" {
            w129 = ["@DO 17 0#", "@DO 18 1#", "@DO 23 1#", "@DO 24 1#", "@DO 25 1#", "@DO 26 0#", "@DO 27 0#", "@DO 28 0#", "@DO 29 1#", "@DO 30 1#", "@DO 31 1#", "@DO 32 1#", "@DO 33 0#"]
            w130 = ["@DO 54 1#", "@DO 55 1#", "@DO 56 1#", "@DO 57 1#", "@DO 58 1#", "@DO 59 1#", "@DO 60 1#", "@DO 61 1#"]
            # @DO 17 0#
            # @DO 18 1#
            # @DO 23 1#
            # @DO 24 1#
            # @DO 25 1#
            # @DO 26 0#
            # @DO 27 0#
            # @DO 28 0#
            # @DO 29 1#
            # @DO 30 1#
            # @DO 31 1#
            # @DO 32 1#
            # @DO 33 0#
            #
            # 03,08,2020
            # 19:51
            Insert Into Array(inArray=w129, new=w130) -> w131
            call "CMD_Iteration.gvi"(VISA_IN=w125, ARRAY_IN=w131, ERROR_IN=w126) -> (ERROR_OUT=w127)
            w128 = w123
          }
          frame "Parallel 2" {
            # @DO 17 1#
            # @DO 18 0#
            # @DO 23 1#
            # @DO 24 0#
            # @DO 25 1#
            # @DO 26 1#
            # @DO 27 1#
            # @DO 28 1#
            # @DO 29 1#
            # @DO 30 1#
            # @DO 31 1#
            # @DO 32 1#
            # @DO 33 1#
            #
            # 03.08.2020
            # 19.53
            w132 = ["@DO 17 1#", "@DO 18 0#", "@DO 23 1#", "@DO 24 0#", "@DO 25 1#", "@DO 26 1#", "@DO 27 1#", "@DO 28 1#", "@DO 29 1#", "@DO 30 1#", "@DO 31 1#", "@DO 32 1#", "@DO 33 1#"]
            # Disconnect all Diodes
            w133 = ["@DO 54 1#", "@DO 55 1#", "@DO 56 1#", "@DO 57 1#", "@DO 58 1#", "@DO 59 1#", "@DO 60 1#", "@DO 61 1#"]
            Insert Into Array(inArray=w132, new=w133) -> w134
            call "CMD_Iteration.gvi"(VISA_IN=w125, ARRAY_IN=w134, ERROR_IN=w126) -> (ERROR_OUT=w127)
            w128 = w123
          }
          frame "Parallel 2 Diode" {
            # @DO 17 1#
            # @DO 18 0#
            # @DO 23 1#
            # @DO 24 0#
            # @DO 25 1#
            # @DO 26 1#
            # @DO 27 1#
            # @DO 28 1#
            # @DO 29 1#
            # @DO 30 1#
            # @DO 31 1#
            # @DO 32 1#
            # @DO 33 1#
            #
            # 03.08.2020
            # 19.54
            w135 = ["@DO 17 1#", "@DO 18 0#", "@DO 23 1#", "@DO 24 0#", "@DO 25 1#", "@DO 26 1#", "@DO 27 1#", "@DO 28 1#", "@DO 29 1#", "@DO 30 1#", "@DO 31 1#", "@DO 32 1#", "@DO 33 1#"]
            # @DO 56 0#
            # @DO 57 0#
            #
            # 19.54
            w136 = ["@DO 54 1#", "@DO 55 1#", "@DO 56 0#", "@DO 57 0#", "@DO 58 1#", "@DO 59 1#", "@DO 60 1#", "@DO 61 1#"]
            Insert Into Array(inArray=w135, new=w136) -> w137
            call "CMD_Iteration.gvi"(VISA_IN=w125, ARRAY_IN=w137, ERROR_IN=w126) -> (ERROR_OUT=w127)
            w128 = w123
          }
          frame "Series 2" {
            # @DO 17 0#
            # @DO 18 1#
            # @DO 23 1#
            # @DO 24 0#
            # @DO 25 1#
            # @DO 26 1#
            # @DO 27 1#
            # @DO 28 1#
            # @DO 29 0#
            # @DO 30 1#
            # @DO 31 1#
            # @DO 32 0#
            # @DO 33 0#
            #
            # 03.08.2020
            # 19.55
            w138 = ["@DO 17 0#", "@DO 18 1#", "@DO 23 1#", "@DO 24 0#", "@DO 25 1#", "@DO 26 1#", "@DO 27 1#", "@DO 28 1#", "@DO 29 0#", "@DO 30 1#", "@DO 31 1#", "@DO 32 0#", "@DO 33 0#"]
            w139 = ["@DO 54 1#", "@DO 55 1#", "@DO 56 1#", "@DO 57 1#", "@DO 58 1#", "@DO 59 1#", "@DO 60 1#", "@DO 61 1#"]
            Insert Into Array(inArray=w138, new=w139) -> w140
            call "CMD_Iteration.gvi"(VISA_IN=w125, ARRAY_IN=w140, ERROR_IN=w126) -> (ERROR_OUT=w127)
            w128 = w123
          }
          frame "Series 2 Diode" {
            # @DO 17 0#
            # @DO 18 1#
            # @DO 23 1#
            # @DO 24 0#
            # @DO 25 1#
            # @DO 26 1#
            # @DO 27 1#
            # @DO 28 1#
            # @DO 29 0#
            # @DO 30 1#
            # @DO 31 1#
            # @DO 32 0#
            # @DO 33 0#
            #
            # 03.08.2020
            # 19.57
            w141 = ["@DO 17 0#", "@DO 18 1#", "@DO 23 1#", "@DO 24 0#", "@DO 25 1#", "@DO 26 1#", "@DO 27 1#", "@DO 28 1#", "@DO 29 0#", "@DO 30 1#", "@DO 31 1#", "@DO 32 0#", "@DO 33 0#"]
            # @DO 60 0#
            # @DO 61 0#
            #
            # 03.08.2020
            w142 = ["@DO 54 1#", "@DO 55 1#", "@DO 56 1#", "@DO 57 1#", "@DO 58 1#", "@DO 59 1#", "@DO 60 0#", "@DO 61 0#"]
            Insert Into Array(inArray=w141, new=w142) -> w143
            call "CMD_Iteration.gvi"(VISA_IN=w125, ARRAY_IN=w143, ERROR_IN=w126) -> (ERROR_OUT=w127)
            w128 = w123
          }
          frame "Parallel 4", Default {
            # @DO 17 1#
            # @DO 18 1#
            # @DO 23 1#
            # @DO 24 1#
            # @DO 25 1#
            # @DO 26 1#
            # @DO 27 1#
            # @DO 28 1#
            # @DO 29 1#
            # @DO 30 1#
            # @DO 31 1#
            # @DO 32 1#
            # @DO 33 1#
            #
            # 03.08.2020
            # 19.59
            w144 = ["@DO 17 1#", "@DO 18 1#", "@DO 23 1#", "@DO 24 1#", "@DO 25 1#", "@DO 26 1#", "@DO 27 1#", "@DO 28 1#", "@DO 29 1#", "@DO 30 1#", "@DO 31 1#", "@DO 32 1#", "@DO 33 1#"]
            w145 = ["@DO 54 1#", "@DO 55 1#", "@DO 56 1#", "@DO 57 1#", "@DO 58 1#", "@DO 59 1#", "@DO 60 1#", "@DO 61 1#"]
            Insert Into Array(inArray=w144, new=w145) -> w146
            call "CMD_Iteration.gvi"(VISA_IN=w125, ARRAY_IN=w146, ERROR_IN=w126) -> (ERROR_OUT=w127)
            w128 = "Parallel 4"
          }
          frame "Parallel 4 Diode" {
            # @DO 17 1#
            # @DO 18 1#
            # @DO 23 1#
            # @DO 24 1#
            # @DO 25 1#
            # @DO 26 1#
            # @DO 27 1#
            # @DO 28 1#
            # @DO 29 1#
            # @DO 30 1#
            # @DO 31 1#
            # @DO 32 1#
            # @DO 33 1#
            # 03.08.2020
            # 20.00
            w147 = ["@DO 17 1#", "@DO 18 1#", "@DO 23 1#", "@DO 24 1#", "@DO 25 1#", "@DO 26 1#", "@DO 27 1#", "@DO 28 1#", "@DO 29 1#", "@DO 30 1#", "@DO 31 1#", "@DO 32 1#", "@DO 33 1#"]
            # @DO 54 0#
            # @DO 55 0#
            # @DO 56 0#
            # @DO 57 0#
            #
            # 03.08.2020
            # 20.00
            w148 = ["@DO 54 0#", "@DO 55 0#", "@DO 56 0#", "@DO 57 0#", "@DO 58 1#", "@DO 59 1#", "@DO 60 1#", "@DO 61 1#"]
            Insert Into Array(inArray=w147, new=w148) -> w149
            call "CMD_Iteration.gvi"(VISA_IN=w125, ARRAY_IN=w149, ERROR_IN=w126) -> (ERROR_OUT=w127)
            w128 = w123
          }
          frame "Series 4" {
            # @DO 17 0#
            # @DO 18 1#
            # @DO 23 0#
            # @DO 24 1#
            # @DO 25 1#
            # @DO 26 0#
            # @DO 27 0#
            # @DO 28 0#
            # @DO 29 0#
            # @DO 30 0#
            # @DO 31 0#
            # @DO 32 0#
            # @DO 33 0#
            #
            # 03.08.2020
            # 20.02
            w150 = ["@DO 17 0#", "@DO 18 1#", "@DO 23 0#", "@DO 24 1#", "@DO 25 1#", "@DO 26 0#", "@DO 27 0#", "@DO 28 0#", "@DO 29 0#", "@DO 30 0#", "@DO 31 0#", "@DO 32 0#", "@DO 33 0#"]
            w151 = ["@DO 54 1#", "@DO 55 1#", "@DO 56 1#", "@DO 57 1#", "@DO 58 1#", "@DO 59 1#", "@DO 60 1#", "@DO 61 1#"]
            Insert Into Array(inArray=w150, new=w151) -> w152
            call "CMD_Iteration.gvi"(VISA_IN=w125, ARRAY_IN=w152, ERROR_IN=w126) -> (ERROR_OUT=w127)
            w128 = w123
          }
          frame "Series 4 Diode" {
            # @DO 17 0#
            # @DO 18 1#
            # @DO 23 0#
            # @DO 24 1#
            # @DO 25 1#
            # @DO 26 0#
            # @DO 27 0#
            # @DO 28 0#
            # @DO 29 0#
            # @DO 30 0#
            # @DO 31 0#
            # @DO 32 0#
            # @DO 33 0#
            #
            # 03.08.2020
            # 20.03
            w153 = ["@DO 17 0#", "@DO 18 1#", "@DO 23 0#", "@DO 24 1#", "@DO 25 1#", "@DO 26 0#", "@DO 27 0#", "@DO 28 0#", "@DO 29 0#", "@DO 30 0#", "@DO 31 0#", "@DO 32 0#", "@DO 33 0#"]
            # @DO 58 0#
            # @DO 59 0#
            # @DO 60 0#
            # @DO 61 0#
            #
            # 03.08.2020
            # 20.04
            w154 = ["@DO 54 1#", "@DO 55 1#", "@DO 56 1#", "@DO 57 1#", "@DO 58 0#", "@DO 59 0#", "@DO 60 0#", "@DO 61 0#"]
            Insert Into Array(inArray=w153, new=w154) -> w155
            call "CMD_Iteration.gvi"(VISA_IN=w125, ARRAY_IN=w155, ERROR_IN=w126) -> (ERROR_OUT=w127)
            w128 = w123
          }
          frame "Parallel Of Series" {
            # @DO 17 1#
            # @DO 18 1#
            # @DO 23 1#
            # @DO 24 1#
            # @DO 25 1#
            # @DO 26 1#
            # @DO 27 0#
            # @DO 28 1#
            # @DO 29 0#
            # @DO 30 0#
            # @DO 31 1#
            # @DO 32 0#
            # @DO 33 1#
            #
            # 03.08.2020
            # 20.05
            w156 = ["@DO 17 1#", "@DO 18 1#", "@DO 23 1#", "@DO 24 1#", "@DO 25 1#", "@DO 26 1#", "@DO 27 0#", "@DO 28 1#", "@DO 29 0#", "@DO 30 0#", "@DO 31 1#", "@DO 32 0#", "@DO 33 1#"]
            w157 = ["@DO 54 1#", "@DO 55 1#", "@DO 56 1#", "@DO 57 1#", "@DO 58 1#", "@DO 59 1#", "@DO 60 1#", "@DO 61 1#"]
            Insert Into Array(inArray=w156, new=w157) -> w158
            call "CMD_Iteration.gvi"(VISA_IN=w125, ARRAY_IN=w158, ERROR_IN=w126) -> (ERROR_OUT=w127)
            w128 = w123
          }
          frame "Parallel Of Series Diode" {
            # @DO 17 1#
            # @DO 18 1#
            # @DO 23 1#
            # @DO 24 1#
            # @DO 25 1#
            # @DO 26 1#
            # @DO 27 0#
            # @DO 28 1#
            # @DO 29 0#
            # @DO 30 0#
            # @DO 31 1#
            # @DO 32 0#
            # @DO 33 1#
            #
            # 03.08.2020
            # 20.06
            # @DO 58 0#
            # @DO 59 0#
            # @DO 60 0#
            # @DO 61 0#
            #
            # 03.08.2020
            # 20.097
            w159 = ["@DO 17 1#", "@DO 18 1#", "@DO 23 1#", "@DO 24 1#", "@DO 25 1#", "@DO 26 1#", "@DO 27 0#", "@DO 28 1#", "@DO 29 0#", "@DO 30 0#", "@DO 31 1#", "@DO 32 0#", "@DO 33 1#"]
            w160 = ["@DO 54 1#", "@DO 55 1#", "@DO 56 1#", "@DO 57 1#", "@DO 58 0#", "@DO 59 0#", "@DO 60 0#", "@DO 61 0#"]
            Insert Into Array(inArray=w159, new=w160) -> w161
            call "CMD_Iteration.gvi"(VISA_IN=w125, ARRAY_IN=w161, ERROR_IN=w126) -> (ERROR_OUT=w127)
            w128 = w123
          }
          frame "Series Of Parallel" {
            w162 = ["@DO 54 1#", "@DO 55 1#", "@DO 56 1#", "@DO 57 1#", "@DO 58 1#", "@DO 59 1#", "@DO 60 1#", "@DO 61 1#"]
            # @DO 17 1#
            # @DO 18 0#
            # @DO 23 0#
            # @DO 24 0#
            # @DO 25 0#
            # @DO 26 1#
            # @DO 27 1#
            # @DO 28 1#
            # @DO 29 1#
            # @DO 30 1#
            # @DO 31 1#
            # @DO 32 1#
            # @DO 33 1#
            #
            # 03.08.2020
            # 20.07
            w163 = ["@DO 17 1#", "@DO 18 0#", "@DO 23 0#", "@DO 24 0#", "@DO 25 0#", "@DO 26 1#", "@DO 27 1#", "@DO 28 1#", "@DO 29 1#", "@DO 30 1#", "@DO 31 1#", "@DO 32 1#", "@DO 33 1#"]
            Insert Into Array(inArray=w163, new=w162) -> w164
            call "CMD_Iteration.gvi"(VISA_IN=w125, ARRAY_IN=w164, ERROR_IN=w126) -> (ERROR_OUT=w127)
            w128 = w123
          }
          frame "Series Of Parallel Diode" {
            # @DO 17 1#
            # @DO 18 0#
            # @DO 23 0#
            # @DO 24 0#
            # @DO 25 0#
            # @DO 26 1#
            # @DO 27 1#
            # @DO 28 1#
            # @DO 29 1#
            # @DO 30 1#
            # @DO 31 1#
            # @DO 32 1#
            # @DO 33 1#
            #
            # 03.08.2020
            # 20.08
            w165 = ["@DO 17 1#", "@DO 18 0#", "@DO 23 0#", "@DO 24 0#", "@DO 25 0#", "@DO 26 1#", "@DO 27 1#", "@DO 28 1#", "@DO 29 1#", "@DO 30 1#", "@DO 31 1#", "@DO 32 1#", "@DO 33 1#"]
            # @DO 54 0#
            # @DO 55 0#
            # @DO 56 0#
            # @DO 57 0#
            #
            # 20.09
            # 03.08.2020
            w166 = ["@DO 54 0#", "@DO 55 0#", "@DO 56 0#", "@DO 57 0#", "@DO 58 1#", "@DO 59 1#", "@DO 60 1#", "@DO 61 1#"]
            Insert Into Array(inArray=w165, new=w166) -> w167
            call "CMD_Iteration.gvi"(VISA_IN=w125, ARRAY_IN=w167, ERROR_IN=w126) -> (ERROR_OUT=w127)
            w128 = w123
          }
        }
        call "PV_switch.gvi"(VISA_IN=w122, CTRL="Connect", ERROR_IN=w127) -> (ERROR_OUT=w47)
        Property Node(instance in=reference to "PV-Panel Cofiguration", "ValueSignaling"=w128)
        w48 = s3
        w49 = default
      }
      frame "Prepare CVM" {
        Property Node(instance in=s4) -> ("VISA Resource"=w168, "Physical Channel"=w169, instance out=w50)
        call "DAQmx Read (Analog 2D DBL NChan NSamp).gvi"(task in=w169, error in=w46, number of samples per channel=1) -> (error out=w170, data=w171)
        Array Index(array=w171) -> (out0[2, 0]=w172)
        Multiply(w172, 4) -> w173
        C Code Node("x"=w173, Error In=w170) -> ("y"=w174, Error Out=w175)
        ~~~
        if(x>-1 && x<=1)
          y = 0;
        if(x>1 && x<=10)
          y = 1;
        if(x>10 && x<=20)
          y = 2;
        if(x>20 && x<=30)
          y = 3;
        ~~~
        Array Index(array=w171) -> (out0[3, 0]=w176)
        # Tip For Local Wiring Solution
        # Relay 1(50) 	DO 1- REP A x1
        # 		DO 0- AMP A x10
        #
        # Relay 2(51) 	DO 1-REP V x1
        # 		DO 0-DIV V x0.25
        # Relay 3(52) 	DO 1-REP V x1
        # 		DO 0-DIV V x0.5
        # Relay 4(53) 	DO 1-REP V x1
        # 		DO 0-AMP V x10
        C Code Node("x"=w176, Error In=w175) -> ("y"=w177, Error Out=w178)
        ~~~
        if(x>-1 && x<=0.6)
          y = 0;
        if(x>0.6 && x<=6)
          y = 1;
        ~~~
        # Voltage Range
        case (w174) {
          frame 0, Default {
            call "CMD_Iteration.gvi"(VISA_IN=w168, ARRAY_IN=["@DO 51 1#", "@DO 52 1#", "@DO 53 0#"], ERROR_IN=w178) -> (VISA Answer=w181, ERROR_OUT=w179)
            w180 = 0.1
          }
          frame 1 {
            call "CMD_Iteration.gvi"(VISA_IN=w168, ARRAY_IN=["@DO 51 1#", "@DO 52 1#", "@DO 53 1#"], ERROR_IN=w178) -> (VISA Answer=w181, ERROR_OUT=w179)
            w180 = 1
          }
          frame 2 {
            call "CMD_Iteration.gvi"(VISA_IN=w168, ARRAY_IN=["@DO 51 1#", "@DO 52 0#", "@DO 53 1#"], ERROR_IN=w178) -> (VISA Answer=w181, ERROR_OUT=w179)
            w180 = 0.5
          }
          frame 3 {
            # Div x0.25 works with 2 relay
            call "CMD_Iteration.gvi"(VISA_IN=w168, ARRAY_IN=["@DO 51 0#\n"], ERROR_IN=w178) -> (VISA Answer=w181, ERROR_OUT=w179)
            w180 = 0.25
          }
        }
        $"Voltage coeff" <- w180
        $"VISA Answer_2" <- w181
        # Current Range
        case (w177) {
          frame 0, Default {
            call "CMD_Iteration.gvi"(VISA_IN=w168, ARRAY_IN=["@DO 50 0#"], ERROR_IN=w179) -> (ERROR_OUT=w47)
            w182 = 0.1
          }
          frame 1 {
            call "CMD_Iteration.gvi"(VISA_IN=w168, ARRAY_IN=["@DO 50 1#"], ERROR_IN=w179) -> (ERROR_OUT=w47)
            w182 = 1
          }
        }
        $"Current coeff" <- w182
        w48 = s3
        w49 = default
      }
      frame "Reset CVM" {
        Property Node(instance in=s4) -> ("VISA Resource"=w183, instance out=w50)
        # VOLTAGE RANGE
        # @DO 51 0#
        # @DO 52 0#
        # @DO 53 0#
        # CURRENT RANGE
        # @DO 50 1#
        call "CMD_Iteration.gvi"(VISA_IN=w183, ARRAY_IN=["@DO 51 1#", "@DO 52 1#", "@DO 53 1#"], ERROR_IN=w46) -> (VISA_OUT=w184, ERROR_OUT=w185)
        call "CMD_Iteration.gvi"(VISA_IN=w184, ARRAY_IN=["@DO 50 1#"], ERROR_IN=w185) -> (ERROR_OUT=w47)
        $"Voltage coeff" <- 1
        $"Current coeff" <- 1
        w48 = s3
        w49 = default
      }
      frame "VAC" {
        w186 = ["0", "1,", "10,", "20,10,", "50,", "50,20,", "100,", "100,40,10,", "200,100,", "500,100,", "1000,", "2000,", "2000,1000,", "4000,", "4000,1000,", "4000,2000,", "4000,2000,1000,", "4000,2000,1000,500,400,100,"]
        Array Size(array=w186) -> (size(s)=w187)
        Is Less Or Equal(x=$"VAC Load Counter", y=w187) -> w188
        Property Node(instance in=s4) -> ("VISA Resource"=w189, "Physical Channel"=w190, instance out=w50)
        Variant To Data(type=timestamp 1904-01-01T00:00:00Z, variant=w45) -> (data=w191)
        Get Current Time() -> (current time=w192)
        Timestamp Subtract(x=w192, y=w191) -> w193
        Is Greater Or Equal(x=w193, y=5) -> w194
        Logical And(w194, w188) -> w195
        call "DAQmx Read (Analog 2D DBL NChan NSamp).gvi"(task in=w190, number of samples per channel=1) -> (data=w196)
        Array Index(array=w196) -> (out0[1, 0]=w197)
        Multiply(w197, 4) -> w198
        Feedback Node(input=w199) -> w200
        Build Array(w200, w198) -> w199
        Array Index(array=w196) -> (out0[0, 0]=w201)
        Divide(x=w201, y=70) -> w202
        Multiply(w202, 1000) -> w203
        Feedback Node(input=w204) -> w205
        Build Array(w205, w203) -> w204
        Build Cluster(w199, w204) -> w206
        case (w195) {
          frame False, Default {
            w207 = w46
            w208 = w191
            w209 = $"VAC Load Counter"
          }
          frame True {
            Get Current Time() -> (current time=w208)
            # Disconnect ALL load
            Array Index(array=w186) -> (out0[$"VAC Load Counter"]=w210)
            w211 = ["@DO 42 1#", "@DO 34 0#", "@DO 35 0#", "@DO 36 0#", "@DO 37 0#", "@DO 38 0#", "@DO 39 0#", "@DO 40 0#", "@DO 41 0#", "@DO 43 0#", "@DO 44 0#", "@DO 45 0#", "@DO 46 0#", "@DO 47 0#", "@DO 48 0#", "@DO 49 0#"]
            call "CMD_Iteration.gvi"(VISA_IN=w189, ARRAY_IN=w211, ERROR_IN=w46) -> (ERROR_OUT=w212)
            s5 = w210  # shift register
            while {
              Match Pattern(regular expression=",", string=s5) -> (after substring=w213, before substring=w214)
              case (w214) {
                frame "1", Default {
                  call "Read_Write_VISA.gvi"(VISA_IN=w189, CMD="@DO 43 1#", ERROR_IN=w212) -> (ERROR_OUT=w215)
                }
                frame "2" {
                  call "Read_Write_VISA.gvi"(VISA_IN=w189, CMD="@DO 44 1#", ERROR_IN=w212) -> (ERROR_OUT=w215)
                }
                frame "3" {
                  call "Read_Write_VISA.gvi"(VISA_IN=w189, CMD="@DO 45 1#", ERROR_IN=w212) -> (ERROR_OUT=w215)
                }
                frame "5" {
                  call "Read_Write_VISA.gvi"(VISA_IN=w189, CMD="@DO 46 1#", ERROR_IN=w212) -> (ERROR_OUT=w215)
                }
                frame "10" {
                  call "Read_Write_VISA.gvi"(VISA_IN=w189, CMD="@DO 47 1#", ERROR_IN=w212) -> (ERROR_OUT=w215)
                }
                frame "20" {
                  call "Read_Write_VISA.gvi"(VISA_IN=w189, CMD="@DO 48 1#", ERROR_IN=w212) -> (ERROR_OUT=w215)
                }
                frame "40" {
                  call "Read_Write_VISA.gvi"(VISA_IN=w189, CMD="@DO 49 1#", ERROR_IN=w212) -> (ERROR_OUT=w215)
                }
                frame "50" {
                  call "Read_Write_VISA.gvi"(VISA_IN=w189, CMD="@DO 34 1#", ERROR_IN=w212) -> (ERROR_OUT=w215)
                }
                frame "100" {
                  call "Read_Write_VISA.gvi"(VISA_IN=w189, CMD="@DO 35 1#", ERROR_IN=w212) -> (ERROR_OUT=w215)
                }
                frame "200" {
                  call "Read_Write_VISA.gvi"(VISA_IN=w189, CMD="@DO 36 1#", ERROR_IN=w212) -> (ERROR_OUT=w215)
                }
                frame "400" {
                  call "Read_Write_VISA.gvi"(VISA_IN=w189, CMD="@DO 37 1#", ERROR_IN=w212) -> (ERROR_OUT=w215)
                }
                frame "500" {
                  call "Read_Write_VISA.gvi"(VISA_IN=w189, CMD="@DO 38 1#", ERROR_IN=w212) -> (ERROR_OUT=w215)
                }
                frame "1000" {
                  call "Read_Write_VISA.gvi"(VISA_IN=w189, CMD="@DO 39 1#", ERROR_IN=w212) -> (ERROR_OUT=w215)
                }
                frame "2000" {
                  call "Read_Write_VISA.gvi"(VISA_IN=w189, CMD="@DO 40 1#", ERROR_IN=w212) -> (ERROR_OUT=w215)
                }
                frame "4000" {
                  call "Read_Write_VISA.gvi"(VISA_IN=w189, CMD="@DO 41 1#", ERROR_IN=w212) -> (ERROR_OUT=w215)
                }
                frame "0" {
                  # Для измерения тока К.З.
                  # Схема сопротивления
                  # 1 Ом + 1 Ом токовый резистор
                  w215 = w212
                }
              }
              Is Empty String Or Path(string/path=w213) -> w216
              next s5 = w213
              stop if w216
            }
            call "Read_Write_VISA.gvi"(VISA_IN=w189, CMD="@DO 42 0#", ERROR_IN=w215) -> (ERROR_OUT=w207)
            Increment(x=$"VAC Load Counter") -> w209
            $VAC <- w206
          }
        }
        call "Enqueue Message (Single).gvi"(message queue in=w43, message="Watchdog", error in=w207) -> (error out=w217)
        case (w188) {
          frame False, Default {
            call "Enqueue Message (Single).gvi"(message queue in=w43, message="Reset LoadR", error in=w217) -> (error out=w47)
          }
          frame True {
            call "Enqueue Message (Single).gvi"(message queue in=w43, message="VAC", message data=w208, error in=w217) -> (error out=w47)
          }
        }
        $"VAC Load Counter" <- w209
        w48 = s3
        w49 = default
      }
      frame "Optic Filter Config" {
        Variant To Data(error in (no error)=w46, type=string "", variant=w45) -> (data=w218, error out=w219)
        case (w218) {
          frame "No Filter", Default {
            w220 = ["@SERV 3 90#", "@SERV 4 0#"]
            w221 = "No Filter"
          }
          frame "Filter 1" {
            w220 = ["@SERV 3 90#", "@SERV 4 0#", "@SERV 3 0#"]
            w221 = w218
          }
          frame "Filter 2" {
            w220 = ["@SERV 3 90#", "@SERV 4 0#", "@SERV 4 90#"]
            w221 = w218
          }
        }
        Property Node(instance in=reference to "PV-Optical Filter", "ValueSignaling"=w221)
        Property Node(instance in=s4) -> ("VISA Resource"=w222, instance out=w50)
        call "CMD_Iteration.gvi"(VISA_IN=w222, ARRAY_IN=w220, ERROR_IN=w219) -> (ERROR_OUT=w47)
        w48 = s3
        w49 = default
      }
      frame "Fans Control" {
        Variant To Data(error in (no error)=w46, type=string "", variant=w45) -> (data=w223, error out=w224)
        case (w223) {
          frame "0", Default {
            w225 = ["@DO 11 0#", "@DO 12 0#"]
            w226 = "0"
          }
          frame "100" {
            w225 = ["@PWM 11 255#", "@PWM 12 255#"]
            w226 = "100"
          }
          frame "50" {
            w225 = ["@PWM 11 127#", "@PWM 12 127#"]
            w226 = "50"
          }
        }
        Property Node(instance in=reference to "PV-Cooling", "ValueSignaling"=w226)
        Property Node(instance in=s4) -> ("VISA Resource"=w227, instance out=w50)
        call "CMD_Iteration.gvi"(VISA_IN=w227, ARRAY_IN=w225, ERROR_IN=w224) -> (ERROR_OUT=w47)
        w48 = s3
        w49 = default
      }
      frame "Heat Config" {
        Variant To Data(error in (no error)=w46, type=string "", variant=w45) -> (data=w228, error out=w229)
        case (w228) {
          frame "0", Default {
            w230 = ["@DO 9 0#"]
            w231 = "0"
          }
          frame "50" {
            w230 = ["@PWM 9 125#"]
            w231 = "50"
          }
          frame "100" {
            w230 = ["@PWM 9 255#"]
            w231 = "100"
          }
        }
        Property Node(instance in=reference to "PV-Heating", "ValueSignaling"=w231)
        Property Node(instance in=s4) -> ("VISA Resource"=w232, instance out=w50)
        call "CMD_Iteration.gvi"(VISA_IN=w232, ARRAY_IN=w230, ERROR_IN=w229) -> (ERROR_OUT=w47)
        w48 = s3
        w49 = default
      }
      frame "Set PV Angle" {
        Variant To Data(error in (no error)=w46, type=u32 0, variant=w45) -> (data=w233, error out=w234)
        # Set angle limits for PV panels
        In Range And Coerce(lower limit=0, upper limit=180, x=w233) -> (coerced(x)=w235)
        Property Node(instance in=reference to "PV-Panel Tilt Angle, º", "ValueSignaling"=w235)
        Property Node(instance in=s4) -> ("VISA Resource"=w236, instance out=w50)
        Number To Decimal String(number=w235) -> (decimal integer string=w237)
        Concatenate Strings("@SERV 13 ", w237, " #") -> w238
        call "Read_Write_VISA.gvi"(VISA_IN=w236, CMD=w238, ERROR_IN=w234) -> (ERROR_OUT=w47)
        w48 = s3
        w49 = default
      }
      frame "Brightness Config" {
        Property Node(instance in=s4) -> ("VISA Resource"=w239, instance out=w50)
        Variant To Data(error in (no error)=w46, type=u32 0, variant=w45) -> (data=w240, error out=w241)
        # Set brightness limits
        In Range And Coerce(lower limit=0, upper limit=100, x=w240) -> (coerced(x)=w242)
        Number To Decimal String(number=w242) -> (decimal integer string=w243)
        Concatenate Strings("@DIM 6 ", w243, "#") -> w244
        call "Read_Write_VISA.gvi"(VISA_IN=w239, CMD=w244, ERROR_IN=w241) -> (ERROR_OUT=w47)
        w48 = s3
        w49 = default
      }
      frame "IR Thermometer" {
        Property Node(instance in=s4) -> ("VISA Resource"=w245, instance out=w50)
        Variant To Data(error in (no error)=w46, type=string "", variant=w45) -> (data=w246, error out=w247)
        case (w246) {
          frame "None", Default {
            w248 = "@SERV 5 0#"
          }
          frame "Panel 1" {
            w248 = "@SERV 5 50#"
          }
          frame "Panel 2" {
            w248 = "@SERV 5 75#"
          }
          frame "Panel 3" {
            w248 = "@SERV 5 110#"
          }
          frame "Panel 4" {
            w248 = "@SERV 5 130#"
          }
        }
        call "Read_Write_VISA.gvi"(VISA_IN=w245, CMD=w248, ERROR_IN=w247) -> (ERROR_OUT=w47)
        w48 = s3
        w49 = default
      }
      frame "Set LoadR" {
        Variant To Data(error in (no error)=w46, type=string "", variant=w45) -> (data=w249, error out=w250)
        Property Node(instance in=s4) -> ("VISA Resource"=w251, instance out=w50)
        # Disconnect ALL load
        w252 = ["@DO 42 1#", "@DO 34 0#", "@DO 35 0#", "@DO 36 0#", "@DO 37 0#", "@DO 38 0#", "@DO 39 0#", "@DO 40 0#", "@DO 41 0#", "@DO 43 0#", "@DO 44 0#", "@DO 45 0#", "@DO 46 0#", "@DO 47 0#", "@DO 48 0#", "@DO 49 0#"]
        call "CMD_Iteration.gvi"(VISA_IN=w251, ARRAY_IN=w252, ERROR_IN=w250) -> (VISA_OUT=w253, ERROR_OUT=w254)
        s6 = w249  # shift register
        while {
          Match Pattern(regular expression=";", string=s6) -> (after substring=w255, before substring=w256)
          s7 = w256  # shift register
          while {
            Match Pattern(regular expression=",", string=s7) -> (after substring=w257, before substring=w258)
            case (w258) {
              frame "1", Default {
                call "Read_Write_VISA.gvi"(VISA_IN=w253, CMD="@DO 43 1#", ERROR_IN=w254) -> (ERROR_OUT=w259)
              }
              frame "2" {
                call "Read_Write_VISA.gvi"(VISA_IN=w253, CMD="@DO 44 1#", ERROR_IN=w254) -> (ERROR_OUT=w259)
              }
              frame "3" {
                call "Read_Write_VISA.gvi"(VISA_IN=w253, CMD="@DO 45 1#", ERROR_IN=w254) -> (ERROR_OUT=w259)
              }
              frame "5" {
                call "Read_Write_VISA.gvi"(VISA_IN=w253, CMD="@DO 46 1#", ERROR_IN=w254) -> (ERROR_OUT=w259)
              }
              frame "10" {
                call "Read_Write_VISA.gvi"(VISA_IN=w253, CMD="@DO 47 1#", ERROR_IN=w254) -> (ERROR_OUT=w259)
              }
              frame "20" {
                call "Read_Write_VISA.gvi"(VISA_IN=w253, CMD="@DO 48 1#", ERROR_IN=w254) -> (ERROR_OUT=w259)
              }
              frame "40" {
                call "Read_Write_VISA.gvi"(VISA_IN=w253, CMD="@DO 49 1#", ERROR_IN=w254) -> (ERROR_OUT=w259)
              }
              frame "50" {
                call "Read_Write_VISA.gvi"(VISA_IN=w253, CMD="@DO 34 1#", ERROR_IN=w254) -> (ERROR_OUT=w259)
              }
              frame "100" {
                call "Read_Write_VISA.gvi"(VISA_IN=w253, CMD="@DO 35 1#", ERROR_IN=w254) -> (ERROR_OUT=w259)
              }
              frame "200" {
                call "Read_Write_VISA.gvi"(VISA_IN=w253, CMD="@DO 36 1#", ERROR_IN=w254) -> (ERROR_OUT=w259)
              }
              frame "400" {
                call "Read_Write_VISA.gvi"(VISA_IN=w253, CMD="@DO 37 1#", ERROR_IN=w254) -> (ERROR_OUT=w259)
              }
              frame "500" {
                call "Read_Write_VISA.gvi"(VISA_IN=w253, CMD="@DO 38 1#", ERROR_IN=w254) -> (ERROR_OUT=w259)
              }
              frame "1000" {
                call "Read_Write_VISA.gvi"(VISA_IN=w253, CMD="@DO 39 1#", ERROR_IN=w254) -> (ERROR_OUT=w259)
              }
              frame "2000" {
                call "Read_Write_VISA.gvi"(VISA_IN=w253, CMD="@DO 40 1#", ERROR_IN=w254) -> (ERROR_OUT=w259)
              }
              frame "4000" {
                call "Read_Write_VISA.gvi"(VISA_IN=w253, CMD="@DO 41 1#", ERROR_IN=w254) -> (ERROR_OUT=w259)
              }
              frame "0" {
                # Для измерения тока К.З.
                # Схема сопротивления
                # 1 Ом + 1 Ом токовый резистор
                w259 = w254
              }
            }
            Decimal String To Number(string=w258) -> (number=w260)
            Feedback Node(input=w261) -> w262
            Add(w260, w262) -> w261
            Is Empty String Or Path(string/path=w257) -> w263
            next s7 = w257
            stop if w263
          }
          Is Empty String Or Path(string/path=w255) -> w264
          next s6 = w255
          stop if w264
        }
        Property Node(instance in=reference to "PV-LoadR,Ohm", "ValueSignaling"=w261)
        # Connect Load
        call "Read_Write_VISA.gvi"(VISA_IN=w251, CMD="@DO 42 0#", ERROR_IN=w259) -> (ERROR_OUT=w47)
        $"Total Set LoadR" <- w261
        w48 = s3
        w49 = default
      }
      frame "Reset LoadR" {
        Property Node(instance in=s4) -> ("VISA Resource"=w265, instance out=w50)
        # Размыкаются всё реле, сопротивление- бесконечность
        w266 = ["@DO 42 1#", "@DO 34 1#", "@DO 35 1#", "@DO 36 1#", "@DO 37 1#", "@DO 38 1#", "@DO 39 1#", "@DO 40 1#", "@DO 41 1#", "@DO 43 1#", "@DO 44 1#", "@DO 45 1#", "@DO 46 1#", "@DO 47 1#", "@DO 48 1#", "@DO 49 1#"]
        # Сопротивление в начальное положение
        call "CMD_Iteration.gvi"(VISA_IN=w265, ARRAY_IN=w266, ERROR_IN=w46) -> (ERROR_OUT=w47)
        w48 = s3
        w49 = default
      }
      frame "Error" {
        Variant To Data(error in (no error)=w46, type=no error, variant=w45) -> (data=w267, error out=w47)
        # #CodeRecommended - If you ever change the name of this "Error" message, you'll need to update the name in the Check Loop Error.vi as well.
        call "Display Error.gvi"(error in=w267)
        w48 = s3
        w49 = default
        w50 = s4
      }
      frame "Exit" {
        Generate User Event(event data=TRUE, user event=w25) -> (error out=w268)
        Release Queue(error in=w46, queue=w43) -> (error out=w269)
        Property Node(instance in=s4) -> ("VISA Resource"=w270, "Physical Channel"=w271)
        call "DAQmx Stop Task.gvi"(task in=w271) -> (error out=w272)
        call "Close (Instr).gvi"(session in=w270, error in=w272) -> (error out=w273)
        Merge Errors(w273, w268, w269) -> (error out=w47)
        w48 = s3
        w49 = TRUE
        w50 = default
      }
      frame Default {
        w274 = "The invalid message string \"%s\" was received in the Message Handling Loop."
        Format Into String(formatString=w274, w44) -> w275
        call "Build Error Cluster.gvi"(code=1, description=w275) -> (error out=w47)
        w48 = s3
        w49 = default
        w50 = s4
      }
    }
    call "Error Handler - Message Handling Loop.gvi"(message queue in=w43, error in=w47) -> (dup error in=w276)
    $Output <- w47
    next s3 = w48
    next s4 = w50
    stop if w49
  }
  $"Server URL" <- "https://api.systemlinkcloud.com/"
  $"Exit 2" <- FALSE
  $SendArrayDoubleToCloud <- "Send Measured Data To Cloud"
  $SendStringToCloud <- "Send String To Cloud"
  $SendDoubleToCloud <- "Send Double To Cloud"
  w277 = bool FALSE  # Stop Event
  Create User Event[EventName="Stop Event"](user event data type=w277) -> (error out=w278, user event out=w279)
  call "Create All Message Queues.gvi"(error in=w278) -> (message queues=w280, error out=w281)
  Property Node(instance in=w280) -> ("UI"=w282)
  s8 = "UI Data.gtype" {all zero or empty}  # shift register
  while {
    call "Dequeue Message.gvi"(message queue in=w282, error in=w281) -> (message queue out=w283, message=w284, message data=w285, error out=w286)
    # s8: Data
    # w279: Stop Event
    case (w284) ignore case {  # Message Cases
      frame "Initialize" {
        Property Node(instance in=s8, "String"=w284) -> (instance out=w288)
        call "Enqueue Message (Single).gvi"(message queue in=w283, message="Update Display", message data=w284, error in=w286) -> (message queue out=w290, error out=w291)
        # Bundle a sample string value.
        call "Enqueue Message (Single).gvi"(message queue in=w290, message=$SendArrayDoubleToCloud, error in=w291) -> (error out=w287)
        Property Node(instance in=reference to "MV-Panel Configuration", "ValueSignaling"="none")
        Property Node(instance in=reference to "PV-Panel Cofiguration", "ValueSignaling"="none")
        Property Node(instance in=reference to "PV-Temperature, ºC", "ValueSignaling"=0)
        Property Node(instance in=reference to "MV-Heating", "ValueSignaling"="none")
        Property Node(instance in=reference to "PV-Heating", "ValueSignaling"="none")
        Property Node(instance in=reference to "MV-Cooling", "ValueSignaling"="none")
        Property Node(instance in=reference to "PV-LightIntensity, W/m2", "ValueSignaling"=0)
        Property Node(instance in=reference to "PV-Cooling", "ValueSignaling"="none")
        Property Node(instance in=reference to "MV-Light Power", "ValueSignaling"="none")
        Property Node(instance in=reference to "PV-Panel Tilt Angle, º", "ValueSignaling"=0)
        Property Node(instance in=reference to "PV-Optical Filter", "ValueSignaling"="none")
        Property Node(instance in=reference to "MV-Optical Filter", "ValueSignaling"="none")
        Property Node(instance in=reference to "PV-LoadR4", "ValueSignaling"="none")
        Property Node(instance in=reference to "PV-Voltage, V", "ValueSignaling"=0)
        Property Node(instance in=reference to "MV-Panel Tilt Angle", "ValueSignaling"="none")
        Property Node(instance in=reference to "PV-LoadR3", "ValueSignaling"="none")
        Property Node(instance in=reference to "PV-Current, mA", "ValueSignaling"=0)
        Property Node(instance in=reference to "MV-LoadR1", "ValueSignaling"="none")
        Property Node(instance in=reference to "PV-LoadR2", "ValueSignaling"="none")
        Property Node(instance in=reference to "PV-LoadR,Ohm", "ValueSignaling"=0)
        Property Node(instance in=reference to "MV-LoadR2", "ValueSignaling"="none")
        Property Node(instance in=reference to "PV-LoadR1", "ValueSignaling"="none")
        Property Node(instance in=reference to "MV-LoadR3", "ValueSignaling"="none")
        Property Node(instance in=reference to "MV-LoadR4", "ValueSignaling"="none")
        w289 = default
      }
      frame "Something" {
        # #CodeNeeded - Perform whatever actions correspond to the "Something" message.
        # Send string to "Update Display" message
        call "Enqueue Message (Single).gvi"(message queue in=w283, message="Update Display", message data="\"Do Something\" button pressed", error in=w286) -> (error out=w287)
        w288 = s8
        w289 = default
      }
      frame "Something Else" {
        # #CodeNeeded - Perform whatever actions correspond to the "Something Else" message.
        # Send string to "Update Display" message
        call "Enqueue Message (Single).gvi"(message queue in=w283, message="Update Display", message data="\"Do Something Else\" button pressed", error in=w286) -> (error out=w287)
        w288 = s8
        w289 = default
      }
      frame "Update Display" {
        # #CodeRecommended - If you wish to decouple the Message Handling Loop from your user interface, consider creating User Events (like the "Stop" event in this VI) to message the Event Handling Loop whenever the user interface needs updating.
        Variant To Data(error in (no error)=w286, type=string "", variant=w285) -> (data=w292, error out=w287)
        $"Status of Send to SystemLink Cycle" <- w292
        w288 = s8
        w289 = default
      }
      frame "Error" {
        Variant To Data(error in (no error)=w286, type=no error, variant=w285) -> (data=w293, error out=w287)
        # #CodeRecommended - Consider creating a system for logging errors in some way. These errors are for notification purposes only. Handling of specific errors should be performed in the message frames that generated the error.
        # #CodeRecommended - If you ever change the name of this "Error" message, you'll need to update the name in the Check Loop Error.vi as well.
        call "Display Error.gvi"(error in=w293)
        w288 = s8
        w289 = default
      }
      frame "---Copy This Frame---" {
        Merge Errors(w286) -> (error out=w287)
        w288 = s8
        w289 = default
      }
      frame "Exit" {
        # Release the message queue reference
        Release Queue(error in=w286, queue=w283) -> (error out=w294)
        # #CodeNeeded - Add any required cleanup code here. Note that if 'Exit' was called as a result of an error, an error dialog will be displayed. Add any custom error handling for an 'Exit' condition here as well.
        Generate User Event(event data=TRUE, user event=w279) -> (error out=w295)
        Merge Errors(w295, w294) -> (error out=w287)
        # Stop the VI
        $"Exit 2" <- TRUE
        w288 = s8
        w289 = TRUE
      }
      frame Default {
        w296 = "The invalid message string \"%s\" was received in the Message Handling Loop."
        Format Into String(formatString=w296, w284) -> w297
        call "Build Error Cluster.gvi"(code=1, description=w297) -> (error out=w287)
        w288 = s8
        w289 = default
      }
      frame "Send Double To Cloud" {
        Property Node(instance in=s8, "String"=w284) -> (instance out=w288)
        call "Open Configuration API Key.gvi"(server url=$"Server URL", api key=$"API Key", error in=w286) -> (configuration=w298)
        Variant To Data(type=string[] [], variant=w285) -> (data=w299)
        Array Index(array=w299) -> (out0[0]=w300, out1[1]=w301)
        Floating Point String To Number(string=w301) -> (number=w302)
        Build Array(w300) -> w303
        call "Query Tags.gvi"(paths=w303, configuration=w298) -> (tags=w304, error out=w305)
        Array Index(array=w304) -> (out0[_]=w306)
        Property Node(instance in=w306) -> ("Path"=w307, "Datatype"=w308)
        call "Open Tag.gvi"(path=w307, data type=w308, error in=w305, configuration=w298) -> (tag=w309, error out=w310)
        call "Write Tag (DBL).gvi"(tag in=w309, value=w302, error in=w310) -> (tag out=w311, error out=w312)
        call "Close Tag (Single).gvi"(tag=w311, error in=w312) -> (error out=w313)
        call "Close Configuration.gvi"(configuration=w298, error in=w313) -> (error out=w287)
        call "Enqueue Message (Single).gvi"(message queue in=w283, message="Update Display", message data=w284)
        w289 = default
      }
      frame "Send Measured Data To Cloud" {
        Property Node(instance in=s8, "String"=w284) -> (instance out=w288)
        call "Enqueue Message (Single).gvi"(message queue in=w283, message="Update Display", message data=w284, error in=w286) -> (message queue out=w314, error out=w315)
        call "Enqueue Message (Single).gvi"(message queue in=w314, message=$SendArrayDoubleToCloud, error in=w315) -> (error out=w316)
        call "Open Configuration API Key.gvi"(server url=$"Server URL", api key=$"API Key", error in=w316) -> (configuration=w317, error out=w318)
        w319 = ["PV-Current", "PV-Voltage", "PV-Temperature", "PV-LigthtIntensity"]
        call "Query Tags.gvi"(paths=w319, error in=w318, configuration=w317) -> (tags=w320, error out=w321)
        for {
          w322 = each element of w320
          w323 = each element of $MeasuredData
          Property Node(instance in=w322) -> ("Path"=w324, "Datatype"=w325)
          call "Open Tag.gvi"(path=w324, data type=w325, error in=w321, configuration=w317) -> (tag=w326, error out=w327)
          call "Write Tag (DBL).gvi"(tag in=w326, value=w323, error in=w327) -> (error out=w328)
        }
        for {
          w329 = each element of w320
          call "Close Tag (Single).gvi"(tag=w329, error in=w328) -> (error out=w330)
        }
        call "Close Configuration.gvi"(configuration=w317, error in=w330) -> (error out=w287)
        w289 = default
      }
      frame "Send String To Cloud" {
        Property Node(instance in=s8, "String"=w284) -> (instance out=w288)
        call "Open Configuration API Key.gvi"(server url=$"Server URL", api key=$"API Key", error in=w286) -> (configuration=w331, error out=w332)
        Variant To Data(type=string[] [], variant=w285) -> (data=w333)
        Array Index(array=w333) -> (out0[0]=w334, out1[1]=w335)
        Build Array(w334) -> w336
        call "Query Tags.gvi"(paths=w336, configuration=w331) -> (tags=w337)
        Array Index(array=w337) -> (out0[_]=w338)
        Property Node(instance in=w338) -> ("Path"=w339, "Datatype"=w340)
        call "Open Tag.gvi"(path=w339, data type=w340, error in=w332, configuration=w331) -> (tag=w341, error out=w342)
        call "Write Tag (String).gvi"(tag in=w341, value=w335, error in=w342) -> (tag out=w343, error out=w344)
        call "Close Tag (Single).gvi"(tag=w343, error in=w344) -> (error out=w345)
        call "Close Configuration.gvi"(configuration=w331, error in=w345) -> (error out=w287)
        call "Enqueue Message (Single).gvi"(message queue in=w283, message="Update Display", message data=w284)
        w289 = default
      }
    }
    call "Error Handler - Message Handling Loop.gvi"(message queue in=w283, error in=w287) -> (dup error in=w346)
    next s8 = w288
    stop if w289
  }
  Register For Events("Stop Event"=w279) -> (event registration refnum out=w347)
  s9 = w347  # shift register
  while {
    event (dynamic events = s9) {
      on "Do Something" Value changed {
        # #CodeNeeded - Send the appropriate message for this user interface event.
        call "Enqueue Message (Single).gvi"(message queue in=w282, message="Something") -> (message queue out=w350, error out=w349)
        w348 = default
      }
      on "Do Something Else" Value changed {
        # #CodeNeeded - Send the appropriate message for this user interface event.
        call "Enqueue Message (Single).gvi"(message queue in=w282, message="Something Else") -> (message queue out=w350, error out=w349)
        w348 = default
      }
      on "Exit" Value changed {
        call "Enqueue Message (Single).gvi"(priority message=TRUE, message queue in=w282, message="Exit") -> (message queue out=w350, error out=w349)
        w348 = default
      }
      on dynamic event 0 {
        # The Message Handling Loop processed an "Exit" message, which fired this event to stop the Event Handling Loop.
        $"Status of Send to SystemLink Cycle" <- "\"Exit\" button pressed"
        w348 = TRUE
        w349 = default
        w350 = w282
      }
      on "Window" Close? {
        call "Enqueue Message (Single).gvi"(priority message=TRUE, message queue in=w282, message="Exit") -> (message queue out=w350)
        Event Filter("Discard?"=TRUE)
        w348 = default
        w349 = default
      }
      on "PV-Current, mA" Value changed {
        Event Data() -> ("New Value"=w351)
        Number To Fractional String(number=w351) -> (F-format string=w352)
        Build Array("PV-Current", w352) -> w353
        call "Enqueue Message (Single).gvi"(message queue in=w282, message=$SendDoubleToCloud, message data=w353) -> (message queue out=w350)
        w348 = default
        w349 = default
      }
      on "PV-LoadR,Ohm" Value changed {
        Event Data() -> ("New Value"=w354)
        Number To Fractional String(number=w354) -> (F-format string=w355)
        Build Array("PV-LoadR", w355) -> w356
        call "Enqueue Message (Single).gvi"(message queue in=w282, message=$SendDoubleToCloud, message data=w356) -> (message queue out=w350)
        w348 = default
        w349 = default
      }
      on "PV-Voltage, V" Value changed {
        Event Data() -> ("New Value"=w357)
        Number To Fractional String(number=w357) -> (F-format string=w358)
        Build Array("PV-Voltage", w358) -> w359
        call "Enqueue Message (Single).gvi"(message queue in=w282, message=$SendDoubleToCloud, message data=w359) -> (message queue out=w350)
        w348 = default
        w349 = default
      }
      on "PV-Temperature, ºC" Value changed {
        Event Data() -> ("New Value"=w360)
        Number To Fractional String(number=w360) -> (F-format string=w361)
        Build Array("PV-Temperature", w361) -> w362
        call "Enqueue Message (Single).gvi"(message queue in=w282, message=$SendDoubleToCloud, message data=w362) -> (message queue out=w350)
        w348 = default
        w349 = default
      }
      on "PV-LightIntensity, W/m2" Value changed {
        Event Data() -> ("New Value"=w363)
        Number To Fractional String(number=w363) -> (F-format string=w364)
        Build Array("PV-LigthtIntensity", w364) -> w365
        call "Enqueue Message (Single).gvi"(message queue in=w282, message=$SendDoubleToCloud, message data=w365) -> (message queue out=w350)
        w348 = default
        w349 = default
      }
      on "PV-Panel Tilt Angle, º" Value changed {
        Event Data() -> ("New Value"=w366)
        Number To Fractional String(number=w366) -> (F-format string=w367)
        Build Array("PV-Panel Tilt Angle", w367) -> w368
        call "Enqueue Message (Single).gvi"(message queue in=w282, message=$SendDoubleToCloud, message data=w368) -> (message queue out=w350)
        w348 = default
        w349 = default
      }
      on "PV-Panel Cofiguration" Value changed {
        Event Data() -> ("New Value"=w369)
        Build Array("PV-Panel Configuration", w369) -> w370
        call "Enqueue Message (Single).gvi"(message queue in=w282, message=$SendStringToCloud, message data=w370) -> (message queue out=w350)
        w348 = default
        w349 = default
      }
      on "PV-Cooling" Value changed {
        Event Data() -> ("New Value"=w371)
        Build Array("PV-Cooling", w371) -> w372
        call "Enqueue Message (Single).gvi"(message queue in=w282, message=$SendStringToCloud, message data=w372) -> (message queue out=w350)
        w348 = default
        w349 = default
      }
      on "PV-Heating" Value changed {
        Event Data() -> ("New Value"=w373)
        Build Array("PV-Heating", w373) -> w374
        call "Enqueue Message (Single).gvi"(message queue in=w282, message=$SendStringToCloud, message data=w374) -> (message queue out=w350)
        w348 = default
        w349 = default
      }
      on "PV-Optical Filter" Value changed {
        Event Data() -> ("New Value"=w375)
        Build Array("PV-Optical Filter", w375) -> w376
        call "Enqueue Message (Single).gvi"(message queue in=w282, message=$SendStringToCloud, message data=w376) -> (message queue out=w350)
        w348 = default
        w349 = default
      }
      on "PV-LoadR1" Value changed {
        Event Data() -> ("New Value"=w377)
        Build Array("PV-LoadR1", w377) -> w378
        call "Enqueue Message (Single).gvi"(message queue in=w282, message=$SendStringToCloud, message data=w378) -> (message queue out=w350)
        w348 = default
        w349 = default
      }
      on "PV-LoadR2" Value changed {
        Event Data() -> ("New Value"=w379)
        Build Array("PV-LoadR2", w379) -> w380
        call "Enqueue Message (Single).gvi"(message queue in=w282, message=$SendStringToCloud, message data=w380) -> (message queue out=w350)
        w348 = default
        w349 = default
      }
      on "PV-LoadR3" Value changed {
        Event Data() -> ("New Value"=w381)
        Build Array("PV-LoadR3", w381) -> w382
        call "Enqueue Message (Single).gvi"(message queue in=w282, message=$SendStringToCloud, message data=w382) -> (message queue out=w350)
        w348 = default
        w349 = default
      }
      on "PV-LoadR4" Value changed {
        Event Data() -> ("New Value"=w383)
        Build Array("PV-LoadR4", w383) -> w384
        call "Enqueue Message (Single).gvi"(message queue in=w282, message=$SendStringToCloud, message data=w384) -> (message queue out=w350)
        w348 = default
        w349 = default
      }
    }
    call "Error Handler - Event Handling Loop.gvi"(message queue in=w350, error in=w349) -> (dup error in=w385)
    stop if w348
  }
  Unregister For Events(error in=w385, event registration refnum=s9) -> (error out=w386)
  Merge Errors(w386, w346) -> (error out=w387)
  Destroy User Event(error in=w387, user event=w279)
  disable {
    frame Enabled { }
    frame Disabled {
      call "Initialize.gvi"(device name="cam0") -> (session out=w388, error out=w389)
      call "Configure Grab.gvi"(session in=w388, error in=w389) -> (session out=w390, error out=w391)
      call "Create Image.gvi"(image name="image_1") -> (new image=w392)
      while {
        call "Grab.gvi"(session in=w390, error in=w391, image in=w392) -> (session out=w393, error out=w394)
        stop if $Stop
      }
      call "Close.gvi"(session=w393, error in=w394)
    }
  }
