vi "PV_switch.gvi"   [LabVIEW NXG 5.0.0]
inputs:
  "VISA_IN": "VISA Instr"
  "CTRL": string = "Disconnect"
  "ERROR_IN": error
outputs:
  "ERROR_OUT": error
uses:
  Queued Message Handler::CMD_Iteration.gvi
diagram:
  case ($CTRL) {
    frame "Connect" {
      call "CMD_Iteration.gvi"(VISA_IN=$VISA_IN, ARRAY_IN=["@DO 21 1#", "@DO 22 1#"], ERROR_IN=$ERROR_IN) -> (ERROR_OUT=w1)
    }
    frame "Disconnect", Default {
      call "CMD_Iteration.gvi"(VISA_IN=$VISA_IN, ARRAY_IN=["@DO 21 0#", "@DO 22 0#"], ERROR_IN=$ERROR_IN) -> (ERROR_OUT=w1)
    }
  }
  $ERROR_OUT <- w1
